# Grasshopper definition 20180725_RhinoHoneybeeToIDF_Basic.gh (Grasshopper 0.9.76)
# plug-ins: Python Interpreter

zone_name = Panel("")
underground_ceiling = Surface()
underground_wall = Surface()
floor_air_exposed = Surface()
underground_slab = Surface()
floor_internal = Surface()
floor_ground = Surface()
air_wall = Surface()
window = Surface()
shading = Surface()
ceiling = Surface()
walls = Surface()
roof = Surface()
entwine = Entwine(
    Branch00=walls,
    Branch01=underground_wall,
    Branch02=roof,
    Branch03=underground_ceiling,
    Branch04=floor_internal,
    Branch05=underground_slab,
    Branch06=floor_ground,
    Branch07=floor_air_exposed,
    Branch08=ceiling,
    Branch09=air_wall,
    FlattenInputs=True)  # -> simplify(Result)
lng = ListLength(List=entwine)
panel = Panel("""WALL
UndergroundWall
ROOF
UndergroundCeiling
FLOOR
UndergroundSlab
SlabOnGrade
ExposedFloor
CEILING
AIRWALL""")
larger = LargerThan(FirstNumber=lng, SecondNumber="0")  # -> flatten(LargerThan), flatten(OrEqualTo)
panel_2 = Panel("""0
0.5
1
1.5
2
2.25
2.5
2.75
3
4""")
python_script = PythonScript(x=larger.LargerThan)  # -> a; inputs x: list of Boolean
# ---------- python_script: Python ----------
a = []
for n, i in enumerate(x):
    if i == True:
        a.append(n)
    else:
        pass
# ---------- end python_script ----------
item = ListItem(List=panel_2, Index=python_script, Wrap=True)  # -> graft(Item)
branch = TreeBranch(Tree=entwine, Path=python_script, MaintainPaths=False)
createhbsrfs = Honeybee_createHBSrfs(geometry=branch, srfType=item)  # -> readMe, simplify(HBSurface); plug-in component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
createhbzones = Honeybee_createHBZones(name=zone_name, HBSurfaces=flatten(createhbsrfs.HBSurface), isConditioned=True)  # -> readMe, HBZone; plug-in component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
addhbglz = Honeybee_addHBGlz(HBObj=createhbzones.HBZone, childSurfaces=flatten(window))  # -> HBObjWGLZ; plug-in component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
python_script_2 = PythonScript(withoutGlazing=createhbzones.HBZone, withGlazing=addhbglz)  # -> result
# ---------- python_script_2: Python ----------
if withGlazing == None:
    result = withoutGlazing
else:
    result = withGlazing
# ---------- end python_script_2 ----------

zone_name_2 = Panel("CM1_LOWER")
underground_ceiling_2 = Surface()
underground_wall_2 = Surface()
floor_air_exposed_2 = Surface()
underground_slab_2 = Surface()
floor_internal_2 = Surface()
floor_ground_2 = Surface(<surface referenced from the Rhino model>)
air_wall_2 = Surface()
window_2 = Surface()
shading_2 = Surface()
ceiling_2 = Surface(<surface referenced from the Rhino model>)
walls_2 = Surface([<surface referenced from the Rhino model> x7])
roof_2 = Surface()
entwine_2 = Entwine(
    Branch00=walls_2,
    Branch01=underground_wall_2,
    Branch02=roof_2,
    Branch03=underground_ceiling_2,
    Branch04=floor_internal_2,
    Branch05=underground_slab_2,
    Branch06=floor_ground_2,
    Branch07=floor_air_exposed_2,
    Branch08=ceiling_2,
    Branch09=air_wall_2,
    FlattenInputs=True)  # -> simplify(Result)
lng_2 = ListLength(List=entwine_2)
larger_2 = LargerThan(FirstNumber=lng_2, SecondNumber="0")  # -> flatten(LargerThan), flatten(OrEqualTo)
panel_4 = Panel("""0
0.5
1
1.5
2
2.25
2.5
2.75
3
4""")
python_script_3 = PythonScript(x=larger_2.LargerThan)  # -> a; inputs x: list of Boolean; same code as python_script
item_2 = ListItem(List=panel_4, Index=python_script_3, Wrap=True)  # -> graft(Item)
branch_2 = TreeBranch(Tree=entwine_2, Path=python_script_3, MaintainPaths=False)
createhbsrfs_2 = Honeybee_createHBSrfs(geometry=branch_2, srfType=item_2)  # -> readMe, simplify(HBSurface); plug-in component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
createhbzones_2 = Honeybee_createHBZones(name=zone_name_2, HBSurfaces=flatten(createhbsrfs_2.HBSurface), isConditioned=True)  # -> readMe, HBZone; plug-in component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
addhbglz_2 = Honeybee_addHBGlz(HBObj=createhbzones_2.HBZone, childSurfaces=flatten(window_2))  # -> HBObjWGLZ; plug-in component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
python_script_4 = PythonScript(withoutGlazing=createhbzones_2.HBZone, withGlazing=addhbglz_2)  # -> result; same code as python_script_2

zone_name_3 = Panel("CM1_UPPER")
underground_ceiling_3 = Surface()
underground_wall_3 = Surface()
floor_air_exposed_3 = Surface()
underground_slab_3 = Surface()
floor_internal_3 = Surface()
floor_ground_3 = Surface(<surface referenced from the Rhino model>)
air_wall_3 = Surface()
window_3 = Surface()
shading_3 = Surface()
ceiling_3 = Surface()
walls_3 = Surface([<surface referenced from the Rhino model> x7])
roof_3 = Surface(<surface referenced from the Rhino model>)
entwine_3 = Entwine(
    Branch00=walls_3,
    Branch01=underground_wall_3,
    Branch02=roof_3,
    Branch03=underground_ceiling_3,
    Branch04=floor_internal_3,
    Branch05=underground_slab_3,
    Branch06=floor_ground_3,
    Branch07=floor_air_exposed_3,
    Branch08=ceiling_3,
    Branch09=air_wall_3,
    FlattenInputs=True)  # -> simplify(Result)
lng_3 = ListLength(List=entwine_3)
larger_3 = LargerThan(FirstNumber=lng_3, SecondNumber="0")  # -> flatten(LargerThan), flatten(OrEqualTo)
panel_6 = Panel("""0
0.5
1
1.5
2
2.25
2.5
2.75
3
4""")
python_script_5 = PythonScript(x=larger_3.LargerThan)  # -> a; inputs x: list of Boolean; same code as python_script
item_3 = ListItem(List=panel_6, Index=python_script_5, Wrap=True)  # -> graft(Item)
branch_3 = TreeBranch(Tree=entwine_3, Path=python_script_5, MaintainPaths=False)
createhbsrfs_3 = Honeybee_createHBSrfs(geometry=branch_3, srfType=item_3)  # -> readMe, simplify(HBSurface); plug-in component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
createhbzones_3 = Honeybee_createHBZones(name=zone_name_3, HBSurfaces=flatten(createhbsrfs_3.HBSurface), isConditioned=True)  # -> readMe, HBZone; plug-in component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
addhbglz_3 = Honeybee_addHBGlz(HBObj=createhbzones_3.HBZone, childSurfaces=flatten(window_3))  # -> HBObjWGLZ; plug-in component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
python_script_6 = PythonScript(withoutGlazing=createhbzones_3.HBZone, withGlazing=addhbglz_3)  # -> result; same code as python_script_2

zone_name_4 = Panel("CM1_MIDDLE")
underground_ceiling_4 = Surface()
underground_wall_4 = Surface()
floor_air_exposed_4 = Surface()
underground_slab_4 = Surface()
floor_internal_4 = Surface(<surface referenced from the Rhino model>)
floor_ground_4 = Surface()
air_wall_4 = Surface()
window_4 = Surface()
shading_4 = Surface()
ceiling_4 = Surface(<surface referenced from the Rhino model>)
walls_4 = Surface([<surface referenced from the Rhino model> x23])
roof_4 = Surface()
entwine_4 = Entwine(
    Branch00=walls_4,
    Branch01=underground_wall_4,
    Branch02=roof_4,
    Branch03=underground_ceiling_4,
    Branch04=floor_internal_4,
    Branch05=underground_slab_4,
    Branch06=floor_ground_4,
    Branch07=floor_air_exposed_4,
    Branch08=ceiling_4,
    Branch09=air_wall_4,
    FlattenInputs=True)  # -> simplify(Result)
lng_4 = ListLength(List=entwine_4)
larger_4 = LargerThan(FirstNumber=lng_4, SecondNumber="0")  # -> flatten(LargerThan), flatten(OrEqualTo)
panel_8 = Panel("""0
0.5
1
1.5
2
2.25
2.5
2.75
3
4""")
python_script_7 = PythonScript(x=larger_4.LargerThan)  # -> a; inputs x: list of Boolean; same code as python_script
item_4 = ListItem(List=panel_8, Index=python_script_7, Wrap=True)  # -> graft(Item)
branch_4 = TreeBranch(Tree=entwine_4, Path=python_script_7, MaintainPaths=False)
createhbsrfs_4 = Honeybee_createHBSrfs(geometry=branch_4, srfType=item_4)  # -> readMe, simplify(HBSurface); plug-in component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
createhbzones_4 = Honeybee_createHBZones(name=zone_name_4, HBSurfaces=flatten(createhbsrfs_4.HBSurface), isConditioned=True)  # -> readMe, HBZone; plug-in component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
addhbglz_4 = Honeybee_addHBGlz(HBObj=createhbzones_4.HBZone, childSurfaces=flatten(window_4))  # -> HBObjWGLZ; plug-in component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
python_script_8 = PythonScript(withoutGlazing=createhbzones_4.HBZone, withGlazing=addhbglz_4)  # -> result; same code as python_script_2

window_5 = Surface()
window_6 = Surface()

zone_name_5 = Panel("CM2_LOWER")
underground_ceiling_5 = Surface()
underground_wall_5 = Surface()
floor_air_exposed_5 = Surface()
underground_slab_5 = Surface()
floor_internal_5 = Surface()
floor_ground_5 = Surface(<surface referenced from the Rhino model>)
air_wall_5 = Surface()
window_7 = Surface()
shading_5 = Surface()
ceiling_5 = Surface(<surface referenced from the Rhino model>)
walls_5 = Surface([<surface referenced from the Rhino model> x4])
roof_5 = Surface()
entwine_5 = Entwine(
    Branch00=walls_5,
    Branch01=underground_wall_5,
    Branch02=roof_5,
    Branch03=underground_ceiling_5,
    Branch04=floor_internal_5,
    Branch05=underground_slab_5,
    Branch06=floor_ground_5,
    Branch07=floor_air_exposed_5,
    Branch08=ceiling_5,
    Branch09=air_wall_5,
    FlattenInputs=True)  # -> simplify(Result)
lng_5 = ListLength(List=entwine_5)
larger_5 = LargerThan(FirstNumber=lng_5, SecondNumber="0")  # -> flatten(LargerThan), flatten(OrEqualTo)
panel_10 = Panel("""0
0.5
1
1.5
2
2.25
2.5
2.75
3
4""")
python_script_9 = PythonScript(x=larger_5.LargerThan)  # -> a; inputs x: list of Boolean; same code as python_script
item_5 = ListItem(List=panel_10, Index=python_script_9, Wrap=True)  # -> graft(Item)
branch_5 = TreeBranch(Tree=entwine_5, Path=python_script_9, MaintainPaths=False)
createhbsrfs_5 = Honeybee_createHBSrfs(geometry=branch_5, srfType=item_5)  # -> readMe, simplify(HBSurface); plug-in component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
createhbzones_5 = Honeybee_createHBZones(name=zone_name_5, HBSurfaces=flatten(createhbsrfs_5.HBSurface), isConditioned=True)  # -> readMe, HBZone; plug-in component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
addhbglz_5 = Honeybee_addHBGlz(HBObj=createhbzones_5.HBZone, childSurfaces=flatten(window_7))  # -> HBObjWGLZ; plug-in component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
python_script_10 = PythonScript(withoutGlazing=createhbzones_5.HBZone, withGlazing=addhbglz_5)  # -> result; same code as python_script_2

zone_name_6 = Panel("CM1_UPPER")
underground_ceiling_6 = Surface()
underground_wall_6 = Surface()
floor_air_exposed_6 = Surface()
underground_slab_6 = Surface()
floor_internal_6 = Surface()
floor_ground_6 = Surface(<surface referenced from the Rhino model>)
air_wall_6 = Surface()
window_8 = Surface()
shading_6 = Surface()
ceiling_6 = Surface()
walls_6 = Surface([<surface referenced from the Rhino model> x4])
roof_6 = Surface(<surface referenced from the Rhino model>)
entwine_6 = Entwine(
    Branch00=walls_6,
    Branch01=underground_wall_6,
    Branch02=roof_6,
    Branch03=underground_ceiling_6,
    Branch04=floor_internal_6,
    Branch05=underground_slab_6,
    Branch06=floor_ground_6,
    Branch07=floor_air_exposed_6,
    Branch08=ceiling_6,
    Branch09=air_wall_6,
    FlattenInputs=True)  # -> simplify(Result)
lng_6 = ListLength(List=entwine_6)
larger_6 = LargerThan(FirstNumber=lng_6, SecondNumber="0")  # -> flatten(LargerThan), flatten(OrEqualTo)
panel_12 = Panel("""0
0.5
1
1.5
2
2.25
2.5
2.75
3
4""")
python_script_11 = PythonScript(x=larger_6.LargerThan)  # -> a; inputs x: list of Boolean; same code as python_script
item_6 = ListItem(List=panel_12, Index=python_script_11, Wrap=True)  # -> graft(Item)
branch_6 = TreeBranch(Tree=entwine_6, Path=python_script_11, MaintainPaths=False)
createhbsrfs_6 = Honeybee_createHBSrfs(geometry=branch_6, srfType=item_6)  # -> readMe, simplify(HBSurface); plug-in component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
createhbzones_6 = Honeybee_createHBZones(name=zone_name_6, HBSurfaces=flatten(createhbsrfs_6.HBSurface), isConditioned=True)  # -> readMe, HBZone; plug-in component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
addhbglz_6 = Honeybee_addHBGlz(HBObj=createhbzones_6.HBZone, childSurfaces=flatten(window_8))  # -> HBObjWGLZ; plug-in component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
python_script_12 = PythonScript(withoutGlazing=createhbzones_6.HBZone, withGlazing=addhbglz_6)  # -> result; same code as python_script_2

zone_name_7 = Panel("CM1_MIDDLE")
underground_ceiling_7 = Surface()
underground_wall_7 = Surface()
floor_air_exposed_7 = Surface()
underground_slab_7 = Surface()
floor_internal_7 = Surface(<surface referenced from the Rhino model>)
floor_ground_7 = Surface()
air_wall_7 = Surface()
window_9 = Surface()
shading_7 = Surface()
ceiling_7 = Surface(<surface referenced from the Rhino model>)
walls_7 = Surface([<surface referenced from the Rhino model> x20])
roof_7 = Surface(<surface referenced from the Rhino model>)
entwine_7 = Entwine(
    Branch00=walls_7,
    Branch01=underground_wall_7,
    Branch02=roof_7,
    Branch03=underground_ceiling_7,
    Branch04=floor_internal_7,
    Branch05=underground_slab_7,
    Branch06=floor_ground_7,
    Branch07=floor_air_exposed_7,
    Branch08=ceiling_7,
    Branch09=air_wall_7,
    FlattenInputs=True)  # -> simplify(Result)
lng_7 = ListLength(List=entwine_7)
larger_7 = LargerThan(FirstNumber=lng_7, SecondNumber="0")  # -> flatten(LargerThan), flatten(OrEqualTo)
panel_14 = Panel("""0
0.5
1
1.5
2
2.25
2.5
2.75
3
4""")
python_script_13 = PythonScript(x=larger_7.LargerThan)  # -> a; inputs x: list of Boolean; same code as python_script
item_7 = ListItem(List=panel_14, Index=python_script_13, Wrap=True)  # -> graft(Item)
branch_7 = TreeBranch(Tree=entwine_7, Path=python_script_13, MaintainPaths=False)
createhbsrfs_7 = Honeybee_createHBSrfs(geometry=branch_7, srfType=item_7)  # -> readMe, simplify(HBSurface); plug-in component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
createhbzones_7 = Honeybee_createHBZones(name=zone_name_7, HBSurfaces=flatten(createhbsrfs_7.HBSurface), isConditioned=True)  # -> readMe, HBZone; plug-in component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
addhbglz_7 = Honeybee_addHBGlz(HBObj=createhbzones_7.HBZone, childSurfaces=flatten(window_9))  # -> HBObjWGLZ; plug-in component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
python_script_14 = PythonScript(withoutGlazing=createhbzones_7.HBZone, withGlazing=addhbglz_7)  # -> result; same code as python_script_2

window_10 = Surface()
window_11 = Surface()
honeybee = Honeybee_Honeybee()  # -> Vviiiiiiiiiizzz; plug-in component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
ladybug = Ladybug_Ladybug()  # -> Vviiiiiiiiiizzz; plug-in component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

zone_name_8 = Panel("CM1_N_INNER")
underground_ceiling_8 = Surface()
underground_wall_8 = Surface()
floor_air_exposed_8 = Surface()
underground_slab_8 = Surface()
floor_internal_8 = Surface(<surface referenced from the Rhino model>)
floor_ground_8 = Surface()
air_wall_8 = Surface(<surface referenced from the Rhino model>)
window_12 = Surface()
shading_8 = Surface()
ceiling_8 = Surface(<surface referenced from the Rhino model>)
walls_8 = Surface([<surface referenced from the Rhino model> x3])
roof_8 = Surface()
entwine_8 = Entwine(
    Branch00=walls_8,
    Branch01=underground_wall_8,
    Branch02=roof_8,
    Branch03=underground_ceiling_8,
    Branch04=floor_internal_8,
    Branch05=underground_slab_8,
    Branch06=floor_ground_8,
    Branch07=floor_air_exposed_8,
    Branch08=ceiling_8,
    Branch09=air_wall_8,
    FlattenInputs=True)  # -> simplify(Result)
lng_8 = ListLength(List=entwine_8)
larger_8 = LargerThan(FirstNumber=lng_8, SecondNumber="0")  # -> flatten(LargerThan), flatten(OrEqualTo)
panel_16 = Panel("""0
0.5
1
1.5
2
2.25
2.5
2.75
3
4""")
python_script_15 = PythonScript(x=larger_8.LargerThan)  # -> a; inputs x: list of Boolean; same code as python_script
item_8 = ListItem(List=panel_16, Index=python_script_15, Wrap=True)  # -> graft(Item)
branch_8 = TreeBranch(Tree=entwine_8, Path=python_script_15, MaintainPaths=False)
createhbsrfs_8 = Honeybee_createHBSrfs(geometry=branch_8, srfType=item_8)  # -> readMe, simplify(HBSurface); plug-in component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
createhbzones_8 = Honeybee_createHBZones(name=zone_name_8, HBSurfaces=flatten(createhbsrfs_8.HBSurface), isConditioned=True)  # -> readMe, HBZone; plug-in component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
addhbglz_8 = Honeybee_addHBGlz(HBObj=createhbzones_8.HBZone, childSurfaces=flatten(window_12))  # -> HBObjWGLZ; plug-in component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
python_script_16 = PythonScript(withoutGlazing=createhbzones_8.HBZone, withGlazing=addhbglz_8)  # -> result; same code as python_script_2

zone_name_9 = Panel("CM1_N_OUTER")
underground_ceiling_9 = Surface()
underground_wall_9 = Surface()
floor_air_exposed_9 = Surface()
underground_slab_9 = Surface()
floor_internal_9 = Surface(<surface referenced from the Rhino model>)
floor_ground_9 = Surface()
air_wall_9 = Surface(<surface referenced from the Rhino model>)
window_13 = Surface()
shading_9 = Surface()
ceiling_9 = Surface(<surface referenced from the Rhino model>)
walls_9 = Surface([<surface referenced from the Rhino model> x3])
roof_9 = Surface()
entwine_9 = Entwine(
    Branch00=walls_9,
    Branch01=underground_wall_9,
    Branch02=roof_9,
    Branch03=underground_ceiling_9,
    Branch04=floor_internal_9,
    Branch05=underground_slab_9,
    Branch06=floor_ground_9,
    Branch07=floor_air_exposed_9,
    Branch08=ceiling_9,
    Branch09=air_wall_9,
    FlattenInputs=True)  # -> simplify(Result)
lng_9 = ListLength(List=entwine_9)
larger_9 = LargerThan(FirstNumber=lng_9, SecondNumber="0")  # -> flatten(LargerThan), flatten(OrEqualTo)
panel_18 = Panel("""0
0.5
1
1.5
2
2.25
2.5
2.75
3
4""")
python_script_17 = PythonScript(x=larger_9.LargerThan)  # -> a; inputs x: list of Boolean; same code as python_script
item_9 = ListItem(List=panel_18, Index=python_script_17, Wrap=True)  # -> graft(Item)
branch_9 = TreeBranch(Tree=entwine_9, Path=python_script_17, MaintainPaths=False)
createhbsrfs_9 = Honeybee_createHBSrfs(geometry=branch_9, srfType=item_9)  # -> readMe, simplify(HBSurface); plug-in component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
createhbzones_9 = Honeybee_createHBZones(name=zone_name_9, HBSurfaces=flatten(createhbsrfs_9.HBSurface), isConditioned=True)  # -> readMe, HBZone; plug-in component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
addhbglz_9 = Honeybee_addHBGlz(HBObj=createhbzones_9.HBZone, childSurfaces=flatten(window_13))  # -> HBObjWGLZ; plug-in component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
python_script_18 = PythonScript(withoutGlazing=createhbzones_9.HBZone, withGlazing=addhbglz_9)  # -> result; same code as python_script_2

zone_name_10 = Panel("CM1_NE_INNER")
underground_ceiling_10 = Surface()
underground_wall_10 = Surface()
floor_air_exposed_10 = Surface()
underground_slab_10 = Surface()
floor_internal_10 = Surface(<surface referenced from the Rhino model>)
floor_ground_10 = Surface()
air_wall_10 = Surface(<surface referenced from the Rhino model>)
window_14 = Surface()
shading_10 = Surface()
ceiling_10 = Surface(<surface referenced from the Rhino model>)
walls_10 = Surface([<surface referenced from the Rhino model> x3])
roof_10 = Surface()
entwine_10 = Entwine(
    Branch00=walls_10,
    Branch01=underground_wall_10,
    Branch02=roof_10,
    Branch03=underground_ceiling_10,
    Branch04=floor_internal_10,
    Branch05=underground_slab_10,
    Branch06=floor_ground_10,
    Branch07=floor_air_exposed_10,
    Branch08=ceiling_10,
    Branch09=air_wall_10,
    FlattenInputs=True)  # -> simplify(Result)
lng_10 = ListLength(List=entwine_10)
larger_10 = LargerThan(FirstNumber=lng_10, SecondNumber="0")  # -> flatten(LargerThan), flatten(OrEqualTo)
panel_20 = Panel("""0
0.5
1
1.5
2
2.25
2.5
2.75
3
4""")
python_script_19 = PythonScript(x=larger_10.LargerThan)  # -> a; inputs x: list of Boolean; same code as python_script
item_10 = ListItem(List=panel_20, Index=python_script_19, Wrap=True)  # -> graft(Item)
branch_10 = TreeBranch(Tree=entwine_10, Path=python_script_19, MaintainPaths=False)
createhbsrfs_10 = Honeybee_createHBSrfs(geometry=branch_10, srfType=item_10)  # -> readMe, simplify(HBSurface); plug-in component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
createhbzones_10 = Honeybee_createHBZones(name=zone_name_10, HBSurfaces=flatten(createhbsrfs_10.HBSurface), isConditioned=True)  # -> readMe, HBZone; plug-in component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
addhbglz_10 = Honeybee_addHBGlz(HBObj=createhbzones_10.HBZone, childSurfaces=flatten(window_14))  # -> HBObjWGLZ; plug-in component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
python_script_20 = PythonScript(withoutGlazing=createhbzones_10.HBZone, withGlazing=addhbglz_10)  # -> result; same code as python_script_2

zone_name_11 = Panel("CM1_NE_OUTER")
underground_ceiling_11 = Surface()
underground_wall_11 = Surface()
floor_air_exposed_11 = Surface()
underground_slab_11 = Surface()
floor_internal_11 = Surface(<surface referenced from the Rhino model>)
floor_ground_11 = Surface()
air_wall_11 = Surface(<surface referenced from the Rhino model>)
window_15 = Surface()
shading_11 = Surface()
ceiling_11 = Surface(<surface referenced from the Rhino model>)
walls_11 = Surface([<surface referenced from the Rhino model> x3])
roof_11 = Surface()
entwine_11 = Entwine(
    Branch00=walls_11,
    Branch01=underground_wall_11,
    Branch02=roof_11,
    Branch03=underground_ceiling_11,
    Branch04=floor_internal_11,
    Branch05=underground_slab_11,
    Branch06=floor_ground_11,
    Branch07=floor_air_exposed_11,
    Branch08=ceiling_11,
    Branch09=air_wall_11,
    FlattenInputs=True)  # -> simplify(Result)
lng_11 = ListLength(List=entwine_11)
larger_11 = LargerThan(FirstNumber=lng_11, SecondNumber="0")  # -> flatten(LargerThan), flatten(OrEqualTo)
panel_22 = Panel("""0
0.5
1
1.5
2
2.25
2.5
2.75
3
4""")
python_script_21 = PythonScript(x=larger_11.LargerThan)  # -> a; inputs x: list of Boolean; same code as python_script
item_11 = ListItem(List=panel_22, Index=python_script_21, Wrap=True)  # -> graft(Item)
branch_11 = TreeBranch(Tree=entwine_11, Path=python_script_21, MaintainPaths=False)
createhbsrfs_11 = Honeybee_createHBSrfs(geometry=branch_11, srfType=item_11)  # -> readMe, simplify(HBSurface); plug-in component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
createhbzones_11 = Honeybee_createHBZones(name=zone_name_11, HBSurfaces=flatten(createhbsrfs_11.HBSurface), isConditioned=True)  # -> readMe, HBZone; plug-in component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
addhbglz_11 = Honeybee_addHBGlz(HBObj=createhbzones_11.HBZone, childSurfaces=flatten(window_15))  # -> HBObjWGLZ; plug-in component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
python_script_22 = PythonScript(withoutGlazing=createhbzones_11.HBZone, withGlazing=addhbglz_11)  # -> result; same code as python_script_2

zone_name_12 = Panel("CM1_SE_INNER")
underground_ceiling_12 = Surface()
underground_wall_12 = Surface()
floor_air_exposed_12 = Surface()
underground_slab_12 = Surface()
floor_internal_12 = Surface(<surface referenced from the Rhino model>)
floor_ground_12 = Surface()
air_wall_12 = Surface(<surface referenced from the Rhino model>)
window_16 = Surface()
shading_12 = Surface()
ceiling_12 = Surface(<surface referenced from the Rhino model>)
walls_12 = Surface([<surface referenced from the Rhino model> x3])
roof_12 = Surface()
entwine_12 = Entwine(
    Branch00=walls_12,
    Branch01=underground_wall_12,
    Branch02=roof_12,
    Branch03=underground_ceiling_12,
    Branch04=floor_internal_12,
    Branch05=underground_slab_12,
    Branch06=floor_ground_12,
    Branch07=floor_air_exposed_12,
    Branch08=ceiling_12,
    Branch09=air_wall_12,
    FlattenInputs=True)  # -> simplify(Result)
lng_12 = ListLength(List=entwine_12)
larger_12 = LargerThan(FirstNumber=lng_12, SecondNumber="0")  # -> flatten(LargerThan), flatten(OrEqualTo)
panel_24 = Panel("""0
0.5
1
1.5
2
2.25
2.5
2.75
3
4""")
python_script_23 = PythonScript(x=larger_12.LargerThan)  # -> a; inputs x: list of Boolean; same code as python_script
item_12 = ListItem(List=panel_24, Index=python_script_23, Wrap=True)  # -> graft(Item)
branch_12 = TreeBranch(Tree=entwine_12, Path=python_script_23, MaintainPaths=False)
createhbsrfs_12 = Honeybee_createHBSrfs(geometry=branch_12, srfType=item_12)  # -> readMe, simplify(HBSurface); plug-in component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
createhbzones_12 = Honeybee_createHBZones(name=zone_name_12, HBSurfaces=flatten(createhbsrfs_12.HBSurface), isConditioned=True)  # -> readMe, HBZone; plug-in component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
addhbglz_12 = Honeybee_addHBGlz(HBObj=createhbzones_12.HBZone, childSurfaces=flatten(window_16))  # -> HBObjWGLZ; plug-in component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
python_script_24 = PythonScript(withoutGlazing=createhbzones_12.HBZone, withGlazing=addhbglz_12)  # -> result; same code as python_script_2

zone_name_13 = Panel("CM1_SE_OUTER")
underground_ceiling_13 = Surface()
underground_wall_13 = Surface()
floor_air_exposed_13 = Surface()
underground_slab_13 = Surface()
floor_internal_13 = Surface(<surface referenced from the Rhino model>)
floor_ground_13 = Surface()
air_wall_13 = Surface(<surface referenced from the Rhino model>)
window_17 = Surface()
shading_13 = Surface()
ceiling_13 = Surface(<surface referenced from the Rhino model>)
walls_13 = Surface([<surface referenced from the Rhino model> x3])
roof_13 = Surface()
entwine_13 = Entwine(
    Branch00=walls_13,
    Branch01=underground_wall_13,
    Branch02=roof_13,
    Branch03=underground_ceiling_13,
    Branch04=floor_internal_13,
    Branch05=underground_slab_13,
    Branch06=floor_ground_13,
    Branch07=floor_air_exposed_13,
    Branch08=ceiling_13,
    Branch09=air_wall_13,
    FlattenInputs=True)  # -> simplify(Result)
lng_13 = ListLength(List=entwine_13)
larger_13 = LargerThan(FirstNumber=lng_13, SecondNumber="0")  # -> flatten(LargerThan), flatten(OrEqualTo)
panel_26 = Panel("""0
0.5
1
1.5
2
2.25
2.5
2.75
3
4""")
python_script_25 = PythonScript(x=larger_13.LargerThan)  # -> a; inputs x: list of Boolean; same code as python_script
item_13 = ListItem(List=panel_26, Index=python_script_25, Wrap=True)  # -> graft(Item)
branch_13 = TreeBranch(Tree=entwine_13, Path=python_script_25, MaintainPaths=False)
createhbsrfs_13 = Honeybee_createHBSrfs(geometry=branch_13, srfType=item_13)  # -> readMe, simplify(HBSurface); plug-in component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
createhbzones_13 = Honeybee_createHBZones(name=zone_name_13, HBSurfaces=flatten(createhbsrfs_13.HBSurface), isConditioned=True)  # -> readMe, HBZone; plug-in component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
addhbglz_13 = Honeybee_addHBGlz(HBObj=createhbzones_13.HBZone, childSurfaces=flatten(window_17))  # -> HBObjWGLZ; plug-in component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
python_script_26 = PythonScript(withoutGlazing=createhbzones_13.HBZone, withGlazing=addhbglz_13)  # -> result; same code as python_script_2

zone_name_14 = Panel("CM1_SW_INNER")
underground_ceiling_14 = Surface()
underground_wall_14 = Surface()
floor_air_exposed_14 = Surface()
underground_slab_14 = Surface()
floor_internal_14 = Surface(<surface referenced from the Rhino model>)
floor_ground_14 = Surface()
air_wall_14 = Surface(<surface referenced from the Rhino model>)
window_18 = Surface()
shading_14 = Surface()
ceiling_14 = Surface(<surface referenced from the Rhino model>)
walls_14 = Surface([<surface referenced from the Rhino model> x3])
roof_14 = Surface()
entwine_14 = Entwine(
    Branch00=walls_14,
    Branch01=underground_wall_14,
    Branch02=roof_14,
    Branch03=underground_ceiling_14,
    Branch04=floor_internal_14,
    Branch05=underground_slab_14,
    Branch06=floor_ground_14,
    Branch07=floor_air_exposed_14,
    Branch08=ceiling_14,
    Branch09=air_wall_14,
    FlattenInputs=True)  # -> simplify(Result)
lng_14 = ListLength(List=entwine_14)
larger_14 = LargerThan(FirstNumber=lng_14, SecondNumber="0")  # -> flatten(LargerThan), flatten(OrEqualTo)
panel_28 = Panel("""0
0.5
1
1.5
2
2.25
2.5
2.75
3
4""")
python_script_27 = PythonScript(x=larger_14.LargerThan)  # -> a; inputs x: list of Boolean; same code as python_script
item_14 = ListItem(List=panel_28, Index=python_script_27, Wrap=True)  # -> graft(Item)
branch_14 = TreeBranch(Tree=entwine_14, Path=python_script_27, MaintainPaths=False)
createhbsrfs_14 = Honeybee_createHBSrfs(geometry=branch_14, srfType=item_14)  # -> readMe, simplify(HBSurface); plug-in component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
createhbzones_14 = Honeybee_createHBZones(name=zone_name_14, HBSurfaces=flatten(createhbsrfs_14.HBSurface), isConditioned=True)  # -> readMe, HBZone; plug-in component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
addhbglz_14 = Honeybee_addHBGlz(HBObj=createhbzones_14.HBZone, childSurfaces=flatten(window_18))  # -> HBObjWGLZ; plug-in component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
python_script_28 = PythonScript(withoutGlazing=createhbzones_14.HBZone, withGlazing=addhbglz_14)  # -> result; same code as python_script_2

zone_name_15 = Panel("CM1_SW_OUTER")
underground_ceiling_15 = Surface()
underground_wall_15 = Surface()
floor_air_exposed_15 = Surface()
underground_slab_15 = Surface()
floor_internal_15 = Surface(<surface referenced from the Rhino model>)
floor_ground_15 = Surface()
air_wall_15 = Surface(<surface referenced from the Rhino model>)
window_19 = Surface()
shading_15 = Surface()
ceiling_15 = Surface(<surface referenced from the Rhino model>)
walls_15 = Surface([<surface referenced from the Rhino model> x3])
roof_15 = Surface()
entwine_15 = Entwine(
    Branch00=walls_15,
    Branch01=underground_wall_15,
    Branch02=roof_15,
    Branch03=underground_ceiling_15,
    Branch04=floor_internal_15,
    Branch05=underground_slab_15,
    Branch06=floor_ground_15,
    Branch07=floor_air_exposed_15,
    Branch08=ceiling_15,
    Branch09=air_wall_15,
    FlattenInputs=True)  # -> simplify(Result)
lng_15 = ListLength(List=entwine_15)
larger_15 = LargerThan(FirstNumber=lng_15, SecondNumber="0")  # -> flatten(LargerThan), flatten(OrEqualTo)
panel_30 = Panel("""0
0.5
1
1.5
2
2.25
2.5
2.75
3
4""")
python_script_29 = PythonScript(x=larger_15.LargerThan)  # -> a; inputs x: list of Boolean; same code as python_script
item_15 = ListItem(List=panel_30, Index=python_script_29, Wrap=True)  # -> graft(Item)
branch_15 = TreeBranch(Tree=entwine_15, Path=python_script_29, MaintainPaths=False)
createhbsrfs_15 = Honeybee_createHBSrfs(geometry=branch_15, srfType=item_15)  # -> readMe, simplify(HBSurface); plug-in component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
createhbzones_15 = Honeybee_createHBZones(name=zone_name_15, HBSurfaces=flatten(createhbsrfs_15.HBSurface), isConditioned=True)  # -> readMe, HBZone; plug-in component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
addhbglz_15 = Honeybee_addHBGlz(HBObj=createhbzones_15.HBZone, childSurfaces=flatten(window_19))  # -> HBObjWGLZ; plug-in component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
python_script_30 = PythonScript(withoutGlazing=createhbzones_15.HBZone, withGlazing=addhbglz_15)  # -> result; same code as python_script_2

zone_name_16 = Panel("CM1_NW_OUTER")
underground_ceiling_16 = Surface()
underground_wall_16 = Surface()
floor_air_exposed_16 = Surface()
underground_slab_16 = Surface()
floor_internal_16 = Surface(<surface referenced from the Rhino model>)
floor_ground_16 = Surface()
air_wall_16 = Surface(<surface referenced from the Rhino model>)
window_20 = Surface()
shading_16 = Surface()
ceiling_16 = Surface(<surface referenced from the Rhino model>)
walls_16 = Surface([<surface referenced from the Rhino model> x3])
roof_16 = Surface()
entwine_16 = Entwine(
    Branch00=walls_16,
    Branch01=underground_wall_16,
    Branch02=roof_16,
    Branch03=underground_ceiling_16,
    Branch04=floor_internal_16,
    Branch05=underground_slab_16,
    Branch06=floor_ground_16,
    Branch07=floor_air_exposed_16,
    Branch08=ceiling_16,
    Branch09=air_wall_16,
    FlattenInputs=True)  # -> simplify(Result)
lng_16 = ListLength(List=entwine_16)
larger_16 = LargerThan(FirstNumber=lng_16, SecondNumber="0")  # -> flatten(LargerThan), flatten(OrEqualTo)
panel_32 = Panel("""0
0.5
1
1.5
2
2.25
2.5
2.75
3
4""")
python_script_31 = PythonScript(x=larger_16.LargerThan)  # -> a; inputs x: list of Boolean; same code as python_script
item_16 = ListItem(List=panel_32, Index=python_script_31, Wrap=True)  # -> graft(Item)
branch_16 = TreeBranch(Tree=entwine_16, Path=python_script_31, MaintainPaths=False)
createhbsrfs_16 = Honeybee_createHBSrfs(geometry=branch_16, srfType=item_16)  # -> readMe, simplify(HBSurface); plug-in component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
createhbzones_16 = Honeybee_createHBZones(name=zone_name_16, HBSurfaces=flatten(createhbsrfs_16.HBSurface), isConditioned=True)  # -> readMe, HBZone; plug-in component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
addhbglz_16 = Honeybee_addHBGlz(HBObj=createhbzones_16.HBZone, childSurfaces=flatten(window_20))  # -> HBObjWGLZ; plug-in component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
python_script_32 = PythonScript(withoutGlazing=createhbzones_16.HBZone, withGlazing=addhbglz_16)  # -> result; same code as python_script_2

zone_name_17 = Panel("CM1_NW_INNER")
underground_ceiling_17 = Surface()
underground_wall_17 = Surface()
floor_air_exposed_17 = Surface()
underground_slab_17 = Surface()
floor_internal_17 = Surface(<surface referenced from the Rhino model>)
floor_ground_17 = Surface()
air_wall_17 = Surface(<surface referenced from the Rhino model>)
window_21 = Surface()
shading_17 = Surface()
ceiling_17 = Surface(<surface referenced from the Rhino model>)
walls_17 = Surface([<surface referenced from the Rhino model> x3])
roof_17 = Surface()
entwine_17 = Entwine(
    Branch00=walls_17,
    Branch01=underground_wall_17,
    Branch02=roof_17,
    Branch03=underground_ceiling_17,
    Branch04=floor_internal_17,
    Branch05=underground_slab_17,
    Branch06=floor_ground_17,
    Branch07=floor_air_exposed_17,
    Branch08=ceiling_17,
    Branch09=air_wall_17,
    FlattenInputs=True)  # -> simplify(Result)
lng_17 = ListLength(List=entwine_17)
larger_17 = LargerThan(FirstNumber=lng_17, SecondNumber="0")  # -> flatten(LargerThan), flatten(OrEqualTo)
panel_34 = Panel("""0
0.5
1
1.5
2
2.25
2.5
2.75
3
4""")
python_script_33 = PythonScript(x=larger_17.LargerThan)  # -> a; inputs x: list of Boolean; same code as python_script
item_17 = ListItem(List=panel_34, Index=python_script_33, Wrap=True)  # -> graft(Item)
branch_17 = TreeBranch(Tree=entwine_17, Path=python_script_33, MaintainPaths=False)
createhbsrfs_17 = Honeybee_createHBSrfs(geometry=branch_17, srfType=item_17)  # -> readMe, simplify(HBSurface); plug-in component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
createhbzones_17 = Honeybee_createHBZones(name=zone_name_17, HBSurfaces=flatten(createhbsrfs_17.HBSurface), isConditioned=True)  # -> readMe, HBZone; plug-in component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
addhbglz_17 = Honeybee_addHBGlz(HBObj=createhbzones_17.HBZone, childSurfaces=flatten(window_21))  # -> HBObjWGLZ; plug-in component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
python_script_34 = PythonScript(withoutGlazing=createhbzones_17.HBZone, withGlazing=addhbglz_17)  # -> result; same code as python_script_2

zone_name_18 = Panel("CM2_S_INNER")
underground_ceiling_18 = Surface()
underground_wall_18 = Surface()
floor_air_exposed_18 = Surface()
underground_slab_18 = Surface()
floor_internal_18 = Surface(<surface referenced from the Rhino model>)
floor_ground_18 = Surface()
air_wall_18 = Surface(<surface referenced from the Rhino model>)
window_22 = Surface()
shading_18 = Surface()
ceiling_18 = Surface(<surface referenced from the Rhino model>)
walls_18 = Surface([<surface referenced from the Rhino model> x3])
roof_18 = Surface()
entwine_18 = Entwine(
    Branch00=walls_18,
    Branch01=underground_wall_18,
    Branch02=roof_18,
    Branch03=underground_ceiling_18,
    Branch04=floor_internal_18,
    Branch05=underground_slab_18,
    Branch06=floor_ground_18,
    Branch07=floor_air_exposed_18,
    Branch08=ceiling_18,
    Branch09=air_wall_18,
    FlattenInputs=True)  # -> simplify(Result)
lng_18 = ListLength(List=entwine_18)
larger_18 = LargerThan(FirstNumber=lng_18, SecondNumber="0")  # -> flatten(LargerThan), flatten(OrEqualTo)
panel_36 = Panel("""0
0.5
1
1.5
2
2.25
2.5
2.75
3
4""")
python_script_35 = PythonScript(x=larger_18.LargerThan)  # -> a; inputs x: list of Boolean; same code as python_script
item_18 = ListItem(List=panel_36, Index=python_script_35, Wrap=True)  # -> graft(Item)
branch_18 = TreeBranch(Tree=entwine_18, Path=python_script_35, MaintainPaths=False)
createhbsrfs_18 = Honeybee_createHBSrfs(geometry=branch_18, srfType=item_18)  # -> readMe, simplify(HBSurface); plug-in component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
createhbzones_18 = Honeybee_createHBZones(name=zone_name_18, HBSurfaces=flatten(createhbsrfs_18.HBSurface), isConditioned=True)  # -> readMe, HBZone; plug-in component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
addhbglz_18 = Honeybee_addHBGlz(HBObj=createhbzones_18.HBZone, childSurfaces=flatten(window_22))  # -> HBObjWGLZ; plug-in component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
python_script_36 = PythonScript(withoutGlazing=createhbzones_18.HBZone, withGlazing=addhbglz_18)  # -> result; same code as python_script_2

zone_name_19 = Panel("CM2_E_INNER")
underground_ceiling_19 = Surface()
underground_wall_19 = Surface()
floor_air_exposed_19 = Surface()
underground_slab_19 = Surface()
floor_internal_19 = Surface(<surface referenced from the Rhino model>)
floor_ground_19 = Surface()
air_wall_19 = Surface(<surface referenced from the Rhino model>)
window_23 = Surface()
shading_19 = Surface()
ceiling_19 = Surface(<surface referenced from the Rhino model>)
walls_19 = Surface([<surface referenced from the Rhino model> x3])
roof_19 = Surface()
entwine_19 = Entwine(
    Branch00=walls_19,
    Branch01=underground_wall_19,
    Branch02=roof_19,
    Branch03=underground_ceiling_19,
    Branch04=floor_internal_19,
    Branch05=underground_slab_19,
    Branch06=floor_ground_19,
    Branch07=floor_air_exposed_19,
    Branch08=ceiling_19,
    Branch09=air_wall_19,
    FlattenInputs=True)  # -> simplify(Result)
lng_19 = ListLength(List=entwine_19)
larger_19 = LargerThan(FirstNumber=lng_19, SecondNumber="0")  # -> flatten(LargerThan), flatten(OrEqualTo)
python_script_37 = PythonScript(x=larger_19.LargerThan)  # -> a; inputs x: list of Boolean; same code as python_script
panel_38 = Panel("""0
0.5
1
1.5
2
2.25
2.5
2.75
3
4""")
item_19 = ListItem(List=panel_38, Index=python_script_37, Wrap=True)  # -> graft(Item)
branch_19 = TreeBranch(Tree=entwine_19, Path=python_script_37, MaintainPaths=False)
createhbsrfs_19 = Honeybee_createHBSrfs(geometry=branch_19, srfType=item_19)  # -> readMe, simplify(HBSurface); plug-in component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
createhbzones_19 = Honeybee_createHBZones(name=zone_name_19, HBSurfaces=flatten(createhbsrfs_19.HBSurface), isConditioned=True)  # -> readMe, HBZone; plug-in component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
addhbglz_19 = Honeybee_addHBGlz(HBObj=createhbzones_19.HBZone, childSurfaces=flatten(window_23))  # -> HBObjWGLZ; plug-in component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
python_script_38 = PythonScript(withoutGlazing=createhbzones_19.HBZone, withGlazing=addhbglz_19)  # -> result; same code as python_script_2

zone_name_20 = Panel("CM2_S_OUTER")
underground_ceiling_20 = Surface()
underground_wall_20 = Surface()
floor_air_exposed_20 = Surface()
underground_slab_20 = Surface()
floor_internal_20 = Surface(<surface referenced from the Rhino model>)
floor_ground_20 = Surface()
air_wall_20 = Surface(<surface referenced from the Rhino model>)
window_24 = Surface()
shading_20 = Surface()
ceiling_20 = Surface(<surface referenced from the Rhino model>)
walls_20 = Surface([<surface referenced from the Rhino model> x3])
roof_20 = Surface()
entwine_20 = Entwine(
    Branch00=walls_20,
    Branch01=underground_wall_20,
    Branch02=roof_20,
    Branch03=underground_ceiling_20,
    Branch04=floor_internal_20,
    Branch05=underground_slab_20,
    Branch06=floor_ground_20,
    Branch07=floor_air_exposed_20,
    Branch08=ceiling_20,
    Branch09=air_wall_20,
    FlattenInputs=True)  # -> simplify(Result)
lng_20 = ListLength(List=entwine_20)
larger_20 = LargerThan(FirstNumber=lng_20, SecondNumber="0")  # -> flatten(LargerThan), flatten(OrEqualTo)
panel_40 = Panel("""0
0.5
1
1.5
2
2.25
2.5
2.75
3
4""")
python_script_39 = PythonScript(x=larger_20.LargerThan)  # -> a; inputs x: list of Boolean; same code as python_script
item_20 = ListItem(List=panel_40, Index=python_script_39, Wrap=True)  # -> graft(Item)
branch_20 = TreeBranch(Tree=entwine_20, Path=python_script_39, MaintainPaths=False)
createhbsrfs_20 = Honeybee_createHBSrfs(geometry=branch_20, srfType=item_20)  # -> readMe, simplify(HBSurface); plug-in component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
createhbzones_20 = Honeybee_createHBZones(name=zone_name_20, HBSurfaces=flatten(createhbsrfs_20.HBSurface), isConditioned=True)  # -> readMe, HBZone; plug-in component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
addhbglz_20 = Honeybee_addHBGlz(HBObj=createhbzones_20.HBZone, childSurfaces=flatten(window_24))  # -> HBObjWGLZ; plug-in component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
python_script_40 = PythonScript(withoutGlazing=createhbzones_20.HBZone, withGlazing=addhbglz_20)  # -> result; same code as python_script_2

zone_name_21 = Panel("CM2_E_OUTER")
underground_ceiling_21 = Surface()
underground_wall_21 = Surface()
floor_air_exposed_21 = Surface()
underground_slab_21 = Surface()
floor_internal_21 = Surface(<surface referenced from the Rhino model>)
floor_ground_21 = Surface()
air_wall_21 = Surface(<surface referenced from the Rhino model>)
window_25 = Surface()
shading_21 = Surface()
ceiling_21 = Surface(<surface referenced from the Rhino model>)
walls_21 = Surface([<surface referenced from the Rhino model> x3])
roof_21 = Surface()
entwine_21 = Entwine(
    Branch00=walls_21,
    Branch01=underground_wall_21,
    Branch02=roof_21,
    Branch03=underground_ceiling_21,
    Branch04=floor_internal_21,
    Branch05=underground_slab_21,
    Branch06=floor_ground_21,
    Branch07=floor_air_exposed_21,
    Branch08=ceiling_21,
    Branch09=air_wall_21,
    FlattenInputs=True)  # -> simplify(Result)
lng_21 = ListLength(List=entwine_21)
larger_21 = LargerThan(FirstNumber=lng_21, SecondNumber="0")  # -> flatten(LargerThan), flatten(OrEqualTo)
python_script_41 = PythonScript(x=larger_21.LargerThan)  # -> a; inputs x: list of Boolean; same code as python_script
panel_42 = Panel("""0
0.5
1
1.5
2
2.25
2.5
2.75
3
4""")
item_21 = ListItem(List=panel_42, Index=python_script_41, Wrap=True)  # -> graft(Item)
branch_21 = TreeBranch(Tree=entwine_21, Path=python_script_41, MaintainPaths=False)
createhbsrfs_21 = Honeybee_createHBSrfs(geometry=branch_21, srfType=item_21)  # -> readMe, simplify(HBSurface); plug-in component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
createhbzones_21 = Honeybee_createHBZones(name=zone_name_21, HBSurfaces=flatten(createhbsrfs_21.HBSurface), isConditioned=True)  # -> readMe, HBZone; plug-in component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
addhbglz_21 = Honeybee_addHBGlz(HBObj=createhbzones_21.HBZone, childSurfaces=flatten(window_25))  # -> HBObjWGLZ; plug-in component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
python_script_42 = PythonScript(withoutGlazing=createhbzones_21.HBZone, withGlazing=addhbglz_21)  # -> result; same code as python_script_2

zone_name_22 = Panel("CM2_W_INNER")
underground_ceiling_22 = Surface()
underground_wall_22 = Surface()
floor_air_exposed_22 = Surface()
underground_slab_22 = Surface()
floor_internal_22 = Surface(<surface referenced from the Rhino model>)
floor_ground_22 = Surface()
air_wall_22 = Surface(<surface referenced from the Rhino model>)
window_26 = Surface()
shading_22 = Surface()
ceiling_22 = Surface(<surface referenced from the Rhino model>)
walls_22 = Surface([<surface referenced from the Rhino model> x3])
roof_22 = Surface()
entwine_22 = Entwine(
    Branch00=walls_22,
    Branch01=underground_wall_22,
    Branch02=roof_22,
    Branch03=underground_ceiling_22,
    Branch04=floor_internal_22,
    Branch05=underground_slab_22,
    Branch06=floor_ground_22,
    Branch07=floor_air_exposed_22,
    Branch08=ceiling_22,
    Branch09=air_wall_22,
    FlattenInputs=True)  # -> simplify(Result)
lng_22 = ListLength(List=entwine_22)
larger_22 = LargerThan(FirstNumber=lng_22, SecondNumber="0")  # -> flatten(LargerThan), flatten(OrEqualTo)
python_script_43 = PythonScript(x=larger_22.LargerThan)  # -> a; inputs x: list of Boolean; same code as python_script
panel_44 = Panel("""0
0.5
1
1.5
2
2.25
2.5
2.75
3
4""")
item_22 = ListItem(List=panel_44, Index=python_script_43, Wrap=True)  # -> graft(Item)
branch_22 = TreeBranch(Tree=entwine_22, Path=python_script_43, MaintainPaths=False)
createhbsrfs_22 = Honeybee_createHBSrfs(geometry=branch_22, srfType=item_22)  # -> readMe, simplify(HBSurface); plug-in component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
createhbzones_22 = Honeybee_createHBZones(name=zone_name_22, HBSurfaces=flatten(createhbsrfs_22.HBSurface), isConditioned=True)  # -> readMe, HBZone; plug-in component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
addhbglz_22 = Honeybee_addHBGlz(HBObj=createhbzones_22.HBZone, childSurfaces=flatten(window_26))  # -> HBObjWGLZ; plug-in component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
python_script_44 = PythonScript(withoutGlazing=createhbzones_22.HBZone, withGlazing=addhbglz_22)  # -> result; same code as python_script_2

zone_name_23 = Panel("CM2_N_INNER")
underground_ceiling_23 = Surface()
underground_wall_23 = Surface()
floor_air_exposed_23 = Surface()
underground_slab_23 = Surface()
floor_internal_23 = Surface(<surface referenced from the Rhino model>)
floor_ground_23 = Surface()
air_wall_23 = Surface(<surface referenced from the Rhino model>)
window_27 = Surface()
shading_23 = Surface()
ceiling_23 = Surface(<surface referenced from the Rhino model>)
walls_23 = Surface([<surface referenced from the Rhino model> x3])
roof_23 = Surface()
entwine_23 = Entwine(
    Branch00=walls_23,
    Branch01=underground_wall_23,
    Branch02=roof_23,
    Branch03=underground_ceiling_23,
    Branch04=floor_internal_23,
    Branch05=underground_slab_23,
    Branch06=floor_ground_23,
    Branch07=floor_air_exposed_23,
    Branch08=ceiling_23,
    Branch09=air_wall_23,
    FlattenInputs=True)  # -> simplify(Result)
lng_23 = ListLength(List=entwine_23)
larger_23 = LargerThan(FirstNumber=lng_23, SecondNumber="0")  # -> flatten(LargerThan), flatten(OrEqualTo)
python_script_45 = PythonScript(x=larger_23.LargerThan)  # -> a; inputs x: list of Boolean; same code as python_script
panel_46 = Panel("""0
0.5
1
1.5
2
2.25
2.5
2.75
3
4""")
item_23 = ListItem(List=panel_46, Index=python_script_45, Wrap=True)  # -> graft(Item)
branch_23 = TreeBranch(Tree=entwine_23, Path=python_script_45, MaintainPaths=False)
createhbsrfs_23 = Honeybee_createHBSrfs(geometry=branch_23, srfType=item_23)  # -> readMe, simplify(HBSurface); plug-in component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
createhbzones_23 = Honeybee_createHBZones(name=zone_name_23, HBSurfaces=flatten(createhbsrfs_23.HBSurface), isConditioned=True)  # -> readMe, HBZone; plug-in component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
addhbglz_23 = Honeybee_addHBGlz(HBObj=createhbzones_23.HBZone, childSurfaces=flatten(window_27))  # -> HBObjWGLZ; plug-in component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
python_script_46 = PythonScript(withoutGlazing=createhbzones_23.HBZone, withGlazing=addhbglz_23)  # -> result; same code as python_script_2

zone_name_24 = Panel("CM2_W_OUTER")
underground_ceiling_24 = Surface()
underground_wall_24 = Surface()
floor_air_exposed_24 = Surface()
underground_slab_24 = Surface()
floor_internal_24 = Surface(<surface referenced from the Rhino model>)
floor_ground_24 = Surface()
air_wall_24 = Surface(<surface referenced from the Rhino model>)
window_28 = Surface()
shading_24 = Surface()
ceiling_24 = Surface(<surface referenced from the Rhino model>)
walls_24 = Surface([<surface referenced from the Rhino model> x3])
roof_24 = Surface()
entwine_24 = Entwine(
    Branch00=walls_24,
    Branch01=underground_wall_24,
    Branch02=roof_24,
    Branch03=underground_ceiling_24,
    Branch04=floor_internal_24,
    Branch05=underground_slab_24,
    Branch06=floor_ground_24,
    Branch07=floor_air_exposed_24,
    Branch08=ceiling_24,
    Branch09=air_wall_24,
    FlattenInputs=True)  # -> simplify(Result)
lng_24 = ListLength(List=entwine_24)
larger_24 = LargerThan(FirstNumber=lng_24, SecondNumber="0")  # -> flatten(LargerThan), flatten(OrEqualTo)
python_script_47 = PythonScript(x=larger_24.LargerThan)  # -> a; inputs x: list of Boolean; same code as python_script
panel_48 = Panel("""0
0.5
1
1.5
2
2.25
2.5
2.75
3
4""")
item_24 = ListItem(List=panel_48, Index=python_script_47, Wrap=True)  # -> graft(Item)
branch_24 = TreeBranch(Tree=entwine_24, Path=python_script_47, MaintainPaths=False)
createhbsrfs_24 = Honeybee_createHBSrfs(geometry=branch_24, srfType=item_24)  # -> readMe, simplify(HBSurface); plug-in component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
createhbzones_24 = Honeybee_createHBZones(name=zone_name_24, HBSurfaces=flatten(createhbsrfs_24.HBSurface), isConditioned=True)  # -> readMe, HBZone; plug-in component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
addhbglz_24 = Honeybee_addHBGlz(HBObj=createhbzones_24.HBZone, childSurfaces=flatten(window_28))  # -> HBObjWGLZ; plug-in component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
python_script_48 = PythonScript(withoutGlazing=createhbzones_24.HBZone, withGlazing=addhbglz_24)  # -> result; same code as python_script_2

zone_name_25 = Panel("CM2_N_OUTER")
underground_ceiling_25 = Surface()
underground_wall_25 = Surface()
floor_air_exposed_25 = Surface()
underground_slab_25 = Surface()
floor_internal_25 = Surface(<surface referenced from the Rhino model>)
floor_ground_25 = Surface()
air_wall_25 = Surface(<surface referenced from the Rhino model>)
window_29 = Surface()
shading_25 = Surface()
ceiling_25 = Surface(<surface referenced from the Rhino model>)
walls_25 = Surface([<surface referenced from the Rhino model> x3])
roof_25 = Surface()
entwine_25 = Entwine(
    Branch00=walls_25,
    Branch01=underground_wall_25,
    Branch02=roof_25,
    Branch03=underground_ceiling_25,
    Branch04=floor_internal_25,
    Branch05=underground_slab_25,
    Branch06=floor_ground_25,
    Branch07=floor_air_exposed_25,
    Branch08=ceiling_25,
    Branch09=air_wall_25,
    FlattenInputs=True)  # -> simplify(Result)
lng_25 = ListLength(List=entwine_25)
larger_25 = LargerThan(FirstNumber=lng_25, SecondNumber="0")  # -> flatten(LargerThan), flatten(OrEqualTo)
python_script_49 = PythonScript(x=larger_25.LargerThan)  # -> a; inputs x: list of Boolean; same code as python_script
panel_50 = Panel("""0
0.5
1
1.5
2
2.25
2.5
2.75
3
4""")
item_25 = ListItem(List=panel_50, Index=python_script_49, Wrap=True)  # -> graft(Item)
branch_25 = TreeBranch(Tree=entwine_25, Path=python_script_49, MaintainPaths=False)
createhbsrfs_25 = Honeybee_createHBSrfs(geometry=branch_25, srfType=item_25)  # -> readMe, simplify(HBSurface); plug-in component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
createhbzones_25 = Honeybee_createHBZones(name=zone_name_25, HBSurfaces=flatten(createhbsrfs_25.HBSurface), isConditioned=True)  # -> readMe, HBZone; plug-in component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
addhbglz_25 = Honeybee_addHBGlz(HBObj=createhbzones_25.HBZone, childSurfaces=flatten(window_29))  # -> HBObjWGLZ; plug-in component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
python_script_50 = PythonScript(withoutGlazing=createhbzones_25.HBZone, withGlazing=addhbglz_25)  # -> result; same code as python_script_2

panel_51 = Panel("C:\Users\tgerrish\Desktop\SAMAzure\TestFiles\Resources\GBR_Cardiff_CIBSE_TRY.epw")
merge = Merge(
    Data1=python_script_36,
    Data2=python_script_40,
    Data3=python_script_38,
    Data4=python_script_42,
    Data5=python_script_46,
    Data6=python_script_50,
    Data7=python_script_44,
    Data8=python_script_48,
    Data9=python_script_10,
    Data10=python_script_14,
    Data11=python_script_12)
merge_2 = Merge(
    Data1=python_script_16,
    Data2=python_script_18,
    Data3=python_script_20,
    Data4=python_script_22,
    Data5=python_script_24,
    Data6=python_script_26,
    Data7=python_script_28,
    Data8=python_script_30,
    Data9=python_script_34,
    Data10=python_script_32,
    Data11=python_script_4,
    Data12=python_script_8,
    Data13=python_script_6)
solveadjc = Honeybee_SolveAdjacencies(HBZones=flatten(merge_2), removeCurrentAdjc=False, findAdjc=Toggle(True))  # -> readMe, HBZonesWADJ; plug-in component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
solveadjc_2 = Honeybee_SolveAdjacencies(HBZones=flatten(merge), removeCurrentAdjc=False, findAdjc=Toggle(True))  # -> readMe, HBZonesWADJ; plug-in component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
data = Data(solveadjc.HBZonesWADJ)
number_slider = Slider(0, range=0..4)
number_slider_2 = Slider(0.2, range=0.2..0.6)

# ---- group: GLAZING RATIO
panel_52 = Panel("0.2")

# ---- group: HORIZONTAL SHADES
panel_53 = Panel("0.1")
panel_54 = Panel("0")

# ----
vertical_shading_fin_depth = Data(Slider(0.1, range=0.1..0.3))
horizontal_shading_fin_depth = Data(Slider(0.1, range=0.1..0.3))
horizontal_shading_fins = Data(Slider(0, range=0..3))
vertical_shading_fins = Data(Slider(0, range=0..3))
fly = Ladybug_fly(inputSliders=number_slider, fly=Toggle(False))  # -> Vviiiiiiiiiizzz; plug-in component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
panel_57 = Panel("""0.2
0.3
0.4
0.5
0.6""")
item_26 = ListItem(List=panel_57, Index=number_slider, Wrap=True)
glazing_ratio = Data(item_26)
glazingcreator = Honeybee_GlazingBasedOnRatio(
    HBObjects=solveadjc.HBZonesWADJ,
    glzRatio=glazing_ratio,
    breakUpWindow=Toggle(True),
    windowHeight="2.8",
    runIt=Toggle(True))  # -> readMe, HBObjWGLZ; plug-in component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
glazingcreator_2 = Honeybee_GlazingBasedOnRatio(
    HBObjects=solveadjc_2.HBZonesWADJ,
    glzRatio=glazing_ratio,
    breakUpWindow=Toggle(True),
    windowHeight="2.8",
    runIt=Toggle(True))  # -> readMe, HBObjWGLZ; plug-in component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
split = SplitList(List=glazingcreator.HBObjWGLZ, Index="10")  # -> ListA, ListB
split_2 = SplitList(List=glazingcreator_2.HBObjWGLZ, Index="8")  # -> ListA, ListB
labelsurfaces = Honeybee_LabelZoneSurfaces(HBObjects=flatten(split.ListB), windows=Toggle(True))  # -> surfaceTxtLabels, labelBasePts, brepTxtLabels, surfaceWireFrames; plug-in component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
labelsurfaces_2 = Honeybee_LabelZoneSurfaces(HBObjects=flatten(split_2.ListB), windows=Toggle(True))  # -> surfaceTxtLabels, labelBasePts, brepTxtLabels, surfaceWireFrames; plug-in component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
remglz = Honeybee_RemoveGlazing(HBZones=flatten(split.ListB), windowName=labelsurfaces.surfaceTxtLabels)  # -> readMe, HBZones; plug-in component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
remglz_2 = Honeybee_RemoveGlazing(HBZones=flatten(split_2.ListB), windowName=labelsurfaces_2.surfaceTxtLabels)  # -> readMe, HBZones; plug-in component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
merge_3 = Merge(Data1=split.ListA, Data2=remglz.HBZones)
merge_4 = Merge(Data1=split_2.ListA, Data2=remglz_2.HBZones)
python = PythonScript(refresh=number_slider)  # -> out, unique_id
# ---------- python: Python ----------
import uuid
unique_id = str(uuid.uuid4())
# ---------- end python ----------
panel_58 = Panel(python.unique_id)
brep = Brep(<brep referenced from the Rhino model>)
debrep = DeconstructBrep(Brep=brep)  # -> Faces, Edges, Vertices

# ---- group: All zones for simulation
merge_5 = Merge(Data1=merge_3, Data2=merge_4)

# ----
epwindowshades = Honeybee_EnergyPlusWindowShadeGenerator(
    HBObjects=flatten(merge_5),
    distToGlass="0.02",
    depth=vertical_shading_fin_depth,
    numOfShds=vertical_shading_fins,
    horOrVertical=Toggle(False),
    runIt=Toggle(True))  # -> readMe, port, HBObjWShades, port_2, windowBreps, shadeBreps, port_3, shadeMatName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; plug-in component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
epwindowshades_2 = Honeybee_EnergyPlusWindowShadeGenerator(
    HBObjects=flatten(merge_5),
    distToGlass="0.02",
    depth=horizontal_shading_fin_depth,
    numOfShds=horizontal_shading_fins,
    runIt=Toggle(True))  # -> readMe, port, HBObjWShades, port_2, windowBreps, shadeBreps, port_3, shadeMatName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; plug-in component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
lng_26 = ListLength(List=epwindowshades.shadeBreps)
lng_27 = ListLength(List=epwindowshades_2.shadeBreps)
smaller = SmallerThan(FirstNumber=lng_26, SecondNumber=vertical_shading_fins)  # -> SmallerThan, flatten(OrEqualTo)
smaller_2 = SmallerThan(FirstNumber=lng_27, SecondNumber=horizontal_shading_fins)  # -> SmallerThan, flatten(OrEqualTo)
python_script_51 = PythonScript(x=smaller.OrEqualTo)  # -> a; inputs x: list of Boolean; same code as python_script
python_script_52 = PythonScript(x=smaller_2.OrEqualTo)  # -> a; inputs x: list of Boolean; same code as python_script
branch_26 = TreeBranch(Tree=epwindowshades.shadeBreps, Path=python_script_51, MaintainPaths=False)
branch_27 = TreeBranch(Tree=epwindowshades_2.shadeBreps, Path=python_script_52, MaintainPaths=False)
hb_epcontextsrf = HoneybeeEPContextSurfaces(shdSurfaces=flatten([branch_27, branch_26, debrep.Faces]))  # -> HBContext; inputs shdSurfaces: list of Brep, justBoundingBox: Boolean
# ---------- hb_epcontextsrf: Python ----------
"""
prepare shading/context geometries

    Args:
        northVectorOrRotation: A vector that shows North or a number that shows
                               the rotation of the North from the Y axis
        bldgMasses: List of closed Breps as thermal zones.
    Returns:
        report: ...
        thermalZones: Thermal zone's geometries for visualiza
"""

ghenv.Component.Name = 'Honeybee EP context Surfaces'
ghenv.Component.NickName = 'HB_EPContextSrf'
ghenv.Component.Message = 'VER 0.0.63\nJAN_20_2018'
ghenv.Component.IconDisplayMode = ghenv.Component.IconDisplayMode.application
ghenv.Component.Category = "Honeybee"
ghenv.Component.SubCategory = "10 | Energy | Energy"
#compatibleHBVersion = VER 0.0.57\nNOV_04_2016
#compatibleLBVersion = VER 0.0.59\nFEB_01_2015
ghenv.Component.AdditionalHelpFromDocStrings = "2"

import rhinoscriptsyntax as rs
import Rhino as rc
import scriptcontext as sc
import os
import System
import Grasshopper.Kernel as gh
import uuid

tolerance = sc.doc.ModelAbsoluteTolerance
import math


def main(shdSurfaces, EPTransSchedule, meshingSettings, justBoundingBox):
    
    # import the classes
    if sc.sticky.has_key('honeybee_release'):

        try:
            if not sc.sticky['honeybee_release'].isCompatible(ghenv.Component): return -1
            if sc.sticky['honeybee_release'].isInputMissing(ghenv.Component): return -1
        except:
            warning = "You need a newer version of Honeybee to use this compoent." + \
            " Use updateHoneybee component to update userObjects.\n" + \
            "If you have already updated userObjects drag Honeybee_Honeybee component " + \
            "into canvas and try again."
            w = gh.GH_RuntimeMessageLevel.Warning
            ghenv.Component.AddRuntimeMessage(w, warning)
            return -1
        
        # don't customize this part
        hb_EPSrf = sc.sticky["honeybee_EPSurface"]
        hb_EPSHDSurface = sc.sticky["honeybee_EPShdSurface"]
        hb_RADMaterialAUX = sc.sticky["honeybee_RADMaterialAUX"]
        hb_EPObjectsAux = sc.sticky["honeybee_EPObjectsAUX"]()
        HBScheduleList = sc.sticky["honeybee_ScheduleLib"].keys()

        ########################################################################
        #----------------------------------------------------------------------#
        shdBreps = []
        # create bounding box of shading geometries
        if justBoundingBox:
            for brep in shdSurfaces:
                if brep.Faces.Count>1 or not brep.Faces[0].IsPlanar(sc.doc.ModelAbsoluteTolerance):
                    shdBreps.append(brep.GetBoundingBox(True).ToBrep())
                else:
                    shdBreps.append(brep)
        else:
            shdBreps = shdSurfaces
        
        shadingClasses = []
        shadingMeshPreview = []
        
        if meshingSettings == None:
            mp = rc.Geometry.MeshingParameters.Minimal
            mp.SimplePlanes = True
        else:
            mp = meshingSettings
        
        def getRadMaterialName(radMaterial):
            nameStr = radMaterial.split(" ")[2]
            name =  nameStr.split("\n")[0]
            return name
        
        for brepCount, brep in enumerate(shdBreps):
            if brep != None:
                isPlanar = True
                # check planarity
                for face in brep.Faces:
                    if not face.IsPlanar(tolerance):
                        isPlanar = False
                        break
                
                shadingBreps = []
                if not isPlanar:
                    meshArray = rc.Geometry.Mesh.CreateFromBrep(brep, mp)
                    for mesh in meshArray:
                        for meshFace in range(mesh.Faces.Count):
                            vertices = list(mesh.Faces.GetFaceVertices(meshFace))[1:]
                            vertices = vertices + [sc.doc.ModelAbsoluteTolerance]
                            # create the brep from mesh
                            shdBrep = rc.Geometry.Brep.CreateFromCornerPoints(*vertices)
                            shadingBreps.append(shdBrep)
                else:
                    for face in brep.Faces:
                        shadingBreps.append(face.DuplicateFace(False))
                
                for faceCount, shdBrep in enumerate(shadingBreps):
                        thisShading = hb_EPSHDSurface(shdBrep, 1000*brepCount + faceCount, 'shdSrf_' + `brepCount` + '_' + `faceCount` + "_" + str(uuid.uuid4()))
                        
                        # add transmittance schedule if any
                        if EPTransSchedule!=None:
                            schedule= EPTransSchedule.upper()
                            if schedule!=None and not schedule.lower().endswith(".csv") and schedule not in HBScheduleList:
                                msg = "Cannot find " + schedule + " in Honeybee schedule library."
                                print msg
                                ghenv.Component.AddRuntimeMessage(gh.GH_RuntimeMessageLevel.Warning, msg)
                                return -1
                            elif schedule!=None and schedule.lower().endswith(".csv"):
                                # check if csv file is existed
                                if not os.path.isfile(schedule):
                                    msg = "Cannot find the shchedule file: " + schedule
                                    print msg
                                    ghenv.Component.AddRuntimeMessage(gh.GH_RuntimeMessageLevel.Warning, msg)
                                    return -1
                            
                            thisShading.TransmittanceSCH = schedule
                        
                        # add the Rad Material if any
                        if RADMaterial!=None:
                            # if it is just the name of the material make sure it is already defined
                            if len(RADMaterial.split(" ")) == 1:
                                # if the material is not in the library add it to the library
                                if not hb_RADMaterialAUX.isMatrialExistInLibrary(RADMaterial):
                                    warningMsg = "Can't find " + RADMaterial + " in RAD Material Library.\n" + \
                                                "Add the material to the library and try again."
                                    ghenv.Component.AddRuntimeMessage(gh.GH_RuntimeMessageLevel.Warning, warningMsg)
                                    return
                                
                                try:
                                    thisShading.setRADMaterial(RADMaterial)
                                except Exception, e:
                                    print e
                                    warningMsg = "You are using an old version of Honeybee_Honeybee! Update your files and try again."
                                    print warningMsg
                                    ghenv.Component.AddRuntimeMessage(gh.GH_RuntimeMessageLevel.Warning, warningMsg)
                                    return
                                
                                addedToLib = True
                            else:
                                
                                # try to add the material to the library
                                addedToLib, thisShading.RadMaterial = hb_RADMaterialAUX.analyseRadMaterials(RADMaterial, True)
                                
                            if addedToLib==False:
                                warningMsg = "Failed to add " + RADMaterial + " to the Library."
                                ghenv.Component.AddRuntimeMessage(gh.GH_RuntimeMessageLevel.Warning, warningMsg)
                                return
                        
                        # add shading to the list
                        shadingClasses.append(thisShading)
                
        # add to the hive
        hb_hive = sc.sticky["honeybee_Hive"]()
        HBContext  = hb_hive.addToHoneybeeHive(shadingClasses, ghenv.Component)
        return HBContext
        ################################################################################################
    else:
        print "You should first let Honeybee to fly..."
        w = gh.GH_RuntimeMessageLevel.Warning
        ghenv.Component.AddRuntimeMessage(w, "You should first let Honeybee to fly...")
        return -1
        

if _shdSurfaces and _shdSurfaces[0]!=None:
    # add cleaning function
    result= main(_shdSurfaces, EPTransSchedule_, meshingSettings_, justBoundingBox_)
    
    if result != -1: HBContext = result
# ---------- end hb_epcontextsrf ----------
panel_59 = Panel("C:\Users\tgerrish\Desktop\SAMAzure\TestFiles\RhinoGrasshopper\IDFs")
python_2 = PythonScript(
    filename=python.unique_id,
    horizontal_shading_fins=horizontal_shading_fins,
    horizontal_shading_fin_depth=horizontal_shading_fin_depth,
    vertical_shading_fins=vertical_shading_fins,
    vertical_shading_fin_depth=vertical_shading_fin_depth,
    glazing_ratio=glazing_ratio,
    dir=panel_59,
    writeJson=Toggle(True))  # -> out, a; inputs writeJson: Boolean
# ---------- python_2: Python ----------
import json
a = filename

json_string = {
    "horizontal_shading_fins": horizontal_shading_fins, 
    "horizontal_shading_fin_depth": horizontal_shading_fin_depth, 
    "vertical_shading_fins": vertical_shading_fins, 
    "vertical_shading_fin_depth": vertical_shading_fin_depth, 
    "glazing_ratio": glazing_ratio,
    "zone_thermal_template": "",
    "glazing_g_value": "",
    "wall_u_value": "",
    "id": filename
}

print(json.dumps(json_string))

#print(json.dumps(json_string, indent=4))
if _writeJson:
    with open("{}\\{}.json".format(_dir, filename), "w") as f:
        json.dump(json_string, f, indent=4)

#print("{}\\{}.json".format(_dir, filename))
# ---------- end python_2 ----------
decomposebytype = Honeybee_DecomposeBasedOnType(HBZone=merge_5)  # -> walls, interiorWalls, airWalls, windows, interiorWindows, skylights, roofs, ceilings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; plug-in component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
preview = CustomPreview(
    Geometry=decomposebytype.interiorWindows,
    Shader={ambient=RGB(0, 0, 0), diffuse=RGB(255, 105, 180), emission=RGB(76, 32, 54), shine=0.5, specular=RGB(255, 255, 255), transparency=0})
labelsurfaces_3 = Honeybee_LabelZoneSurfaces(HBObjects=flatten(solveadjc.HBZonesWADJ))  # -> surfaceTxtLabels, labelBasePts, brepTxtLabels, surfaceWireFrames; disabled; plug-in component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
runenergysimulation = Honeybee_RunEnergySimulation(
    epwFile=panel_51,
    HBZones=flatten(merge_5),
    HBContext=flatten(hb_epcontextsrf),
    writeIdf=Toggle(True),
    workingDir=panel_59,
    idfFileName=python_2.a)  # -> readMe, idfFileAddress, resultFileAddress, eioFileAddress, rddFileAddress, htmlReport, studyFolder; plug-in component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
preview_2 = CustomPreview(Geometry=decomposebytype.walls, Shader=ColourSwatch(SwatchColor=RGB(255, 209, 56)))
preview_3 = CustomPreview(Geometry=decomposebytype.interiorWalls, Shader=ColourSwatch(SwatchColor=RGB(255, 240, 191)))
preview_4 = CustomPreview(Geometry=decomposebytype.airWalls, Shader=ColourSwatch(SwatchColor=RGBA(255, 255, 255, 58)))
preview_5 = CustomPreview(Geometry=decomposebytype.floors, Shader=ColourSwatch(SwatchColor=RGB(0, 143, 100)))
preview_6 = CustomPreview(Geometry=decomposebytype.undergroundWalls, Shader=ColourSwatch(SwatchColor=RGB(54, 0, 0)))
preview_7 = CustomPreview(Geometry=decomposebytype.ceilings, Shader=ColourSwatch(SwatchColor=RGB(18, 117, 0)))
preview_8 = CustomPreview(Geometry=decomposebytype.groundFloors, Shader=ColourSwatch(SwatchColor=RGB(71, 71, 71)))
preview_9 = CustomPreview(Geometry=decomposebytype.exposedFloors, Shader=ColourSwatch(SwatchColor=RGB(161, 161, 161)))
preview_10 = CustomPreview(Geometry=decomposebytype.windows, Shader=ColourSwatch(SwatchColor=RGBA(0, 208, 255, 128)))
preview_11 = CustomPreview(Geometry=decomposebytype.skylights, Shader=ColourSwatch(SwatchColor=RGBA(94, 97, 255, 113)))
preview_12 = CustomPreview(Geometry=decomposebytype.interiorWindows, Shader=ColourSwatch(SwatchColor=RGBA(0, 208, 255, 115)))
preview_13 = CustomPreview(Geometry=decomposebytype.roofs, Shader=ColourSwatch(SwatchColor=RGB(176, 29, 0)))
panel_60 = Panel(runenergysimulation.idfFileAddress)
