# Grasshopper definition RhinoHoneybeeToIDF.gh (Grasshopper 0.9.76)
# plug-ins: Python Interpreter

honeybee = Honeybee_Honeybee()  # -> Vviiiiiiiiiizzz; plug-in component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
ladybug = Ladybug_Ladybug()  # -> Vviiiiiiiiiizzz; plug-in component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

exposedfloors = Surface()
airwalls = Surface(<surface referenced from the Rhino model>)
ceilings = Surface(<surface referenced from the Rhino model>)
walls = Surface([<surface referenced from the Rhino model> x3])
floors = Surface(<surface referenced from the Rhino model>)
roofs = Surface()
createhbsrfs = Honeybee_createHBSrfs(geometry=walls, srfType="0")  # -> readMe, simplify(HBSurface); plug-in component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
createhbsrfs_2 = Honeybee_createHBSrfs(geometry=ceilings, srfType="3")  # -> readMe, simplify(HBSurface); plug-in component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
createhbsrfs_3 = Honeybee_createHBSrfs(geometry=airwalls, srfType="4")  # -> readMe, simplify(HBSurface); plug-in component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
createhbsrfs_4 = Honeybee_createHBSrfs(geometry=floors, srfType="2")  # -> readMe, simplify(HBSurface); plug-in component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
createhbsrfs_5 = Honeybee_createHBSrfs(geometry=roofs, srfType="1")  # -> readMe, simplify(HBSurface); plug-in component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
createhbsrfs_6 = Honeybee_createHBSrfs(geometry=exposedfloors, srfType="2.75")  # -> readMe, simplify(HBSurface); plug-in component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
merge = Merge(
    Data1=flatten(createhbsrfs.HBSurface),
    Data2=flatten(createhbsrfs_3.HBSurface),
    Data3=flatten(createhbsrfs_2.HBSurface),
    Data4=flatten(createhbsrfs_4.HBSurface),
    Data5=flatten(createhbsrfs_5.HBSurface),
    Data6=flatten(createhbsrfs_6.HBSurface))  # -> flatten(Result)
null = NullItem(Item=merge)  # -> NullFlags, InvalidFlags, Description
dispatch = Dispatch(List=merge, DispatchPattern=null.NullFlags)  # -> ListA, ListB
createhbzones = Honeybee_createHBZones(name="CM2_S_Outer", HBSurfaces=flatten(dispatch.ListB), isConditioned=True)  # -> readMe, HBZone; plug-in component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
hbzone = Geometry(createhbzones.HBZone)

exposedfloors_2 = Surface()
airwalls_2 = Surface(<surface referenced from the Rhino model>)
ceilings_2 = Surface(<surface referenced from the Rhino model>)
walls_2 = Surface([<surface referenced from the Rhino model> x3])
floors_2 = Surface(<surface referenced from the Rhino model>)
roofs_2 = Surface()
createhbsrfs_7 = Honeybee_createHBSrfs(geometry=walls_2, srfType="0")  # -> readMe, simplify(HBSurface); plug-in component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
createhbsrfs_8 = Honeybee_createHBSrfs(geometry=ceilings_2, srfType="3")  # -> readMe, simplify(HBSurface); plug-in component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
createhbsrfs_9 = Honeybee_createHBSrfs(geometry=airwalls_2, srfType="4")  # -> readMe, simplify(HBSurface); plug-in component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
createhbsrfs_10 = Honeybee_createHBSrfs(geometry=floors_2, srfType="2")  # -> readMe, simplify(HBSurface); plug-in component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
createhbsrfs_11 = Honeybee_createHBSrfs(geometry=roofs_2, srfType="1")  # -> readMe, simplify(HBSurface); plug-in component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
createhbsrfs_12 = Honeybee_createHBSrfs(geometry=exposedfloors_2, srfType="2.75")  # -> readMe, simplify(HBSurface); plug-in component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
merge_2 = Merge(
    Data1=flatten(createhbsrfs_7.HBSurface),
    Data2=flatten(createhbsrfs_9.HBSurface),
    Data3=flatten(createhbsrfs_8.HBSurface),
    Data4=flatten(createhbsrfs_10.HBSurface),
    Data5=flatten(createhbsrfs_11.HBSurface),
    Data6=flatten(createhbsrfs_12.HBSurface))  # -> flatten(Result)
null_2 = NullItem(Item=merge_2)  # -> NullFlags, InvalidFlags, Description
dispatch_2 = Dispatch(List=merge_2, DispatchPattern=null_2.NullFlags)  # -> ListA, ListB
createhbzones_2 = Honeybee_createHBZones(name="CM2_N_Outer", HBSurfaces=flatten(dispatch_2.ListB), isConditioned=True)  # -> readMe, HBZone; plug-in component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
hbzone_2 = Geometry(createhbzones_2.HBZone)

exposedfloors_3 = Surface()
airwalls_3 = Surface(<surface referenced from the Rhino model>)
ceilings_3 = Surface(<surface referenced from the Rhino model>)
walls_3 = Surface([<surface referenced from the Rhino model> x3])
floors_3 = Surface(<surface referenced from the Rhino model>)
roofs_3 = Surface()
createhbsrfs_13 = Honeybee_createHBSrfs(geometry=walls_3, srfType="0")  # -> readMe, simplify(HBSurface); plug-in component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
createhbsrfs_14 = Honeybee_createHBSrfs(geometry=ceilings_3, srfType="3")  # -> readMe, simplify(HBSurface); plug-in component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
createhbsrfs_15 = Honeybee_createHBSrfs(geometry=airwalls_3, srfType="4")  # -> readMe, simplify(HBSurface); plug-in component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
createhbsrfs_16 = Honeybee_createHBSrfs(geometry=floors_3, srfType="2")  # -> readMe, simplify(HBSurface); plug-in component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
createhbsrfs_17 = Honeybee_createHBSrfs(geometry=roofs_3, srfType="1")  # -> readMe, simplify(HBSurface); plug-in component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
createhbsrfs_18 = Honeybee_createHBSrfs(geometry=exposedfloors_3, srfType="2.75")  # -> readMe, simplify(HBSurface); plug-in component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
merge_3 = Merge(
    Data1=flatten(createhbsrfs_13.HBSurface),
    Data2=flatten(createhbsrfs_15.HBSurface),
    Data3=flatten(createhbsrfs_14.HBSurface),
    Data4=flatten(createhbsrfs_16.HBSurface),
    Data5=flatten(createhbsrfs_17.HBSurface),
    Data6=flatten(createhbsrfs_18.HBSurface))  # -> flatten(Result)
null_3 = NullItem(Item=merge_3)  # -> NullFlags, InvalidFlags, Description
dispatch_3 = Dispatch(List=merge_3, DispatchPattern=null_3.NullFlags)  # -> ListA, ListB
createhbzones_3 = Honeybee_createHBZones(name="CM2_S_Inner", HBSurfaces=flatten(dispatch_3.ListB), isConditioned=True)  # -> readMe, HBZone; plug-in component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
hbzone_3 = Geometry(createhbzones_3.HBZone)

exposedfloors_4 = Surface()
airwalls_4 = Surface(<surface referenced from the Rhino model>)
ceilings_4 = Surface(<surface referenced from the Rhino model>)
walls_4 = Surface([<surface referenced from the Rhino model> x3])
windows = Surface()
floors_4 = Surface(<surface referenced from the Rhino model>)
roofs_4 = Surface()
createhbsrfs_19 = Honeybee_createHBSrfs(geometry=walls_4, srfType="0")  # -> readMe, simplify(HBSurface); plug-in component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
createhbsrfs_20 = Honeybee_createHBSrfs(geometry=ceilings_4, srfType="3")  # -> readMe, simplify(HBSurface); plug-in component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
createhbsrfs_21 = Honeybee_createHBSrfs(geometry=airwalls_4, srfType="4")  # -> readMe, simplify(HBSurface); plug-in component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
createhbsrfs_22 = Honeybee_createHBSrfs(geometry=floors_4, srfType="2")  # -> readMe, simplify(HBSurface); plug-in component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
createhbsrfs_23 = Honeybee_createHBSrfs(geometry=roofs_4, srfType="1")  # -> readMe, simplify(HBSurface); plug-in component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
createhbsrfs_24 = Honeybee_createHBSrfs(geometry=exposedfloors_4, srfType="2.75")  # -> readMe, simplify(HBSurface); plug-in component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
merge_4 = Merge(
    Data1=flatten(createhbsrfs_19.HBSurface),
    Data2=flatten(createhbsrfs_21.HBSurface),
    Data3=flatten(createhbsrfs_20.HBSurface),
    Data4=flatten(createhbsrfs_22.HBSurface),
    Data5=flatten(createhbsrfs_23.HBSurface),
    Data6=flatten(createhbsrfs_24.HBSurface))  # -> flatten(Result)
null_4 = NullItem(Item=merge_4)  # -> NullFlags, InvalidFlags, Description
dispatch_4 = Dispatch(List=merge_4, DispatchPattern=null_4.NullFlags)  # -> ListA, ListB
createhbzones_4 = Honeybee_createHBZones(name="CM1_SE_Outer", HBSurfaces=flatten(dispatch_4.ListB), isConditioned=True)  # -> readMe, HBZone; plug-in component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
hbzone_4 = Geometry(createhbzones_4.HBZone)

exposedfloors_5 = Surface()
airwalls_5 = Surface(<surface referenced from the Rhino model>)
ceilings_5 = Surface(<surface referenced from the Rhino model>)
walls_5 = Surface([<surface referenced from the Rhino model> x3])
floors_5 = Surface(<surface referenced from the Rhino model>)
roofs_5 = Surface()
createhbsrfs_25 = Honeybee_createHBSrfs(geometry=walls_5, srfType="0")  # -> readMe, simplify(HBSurface); plug-in component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
createhbsrfs_26 = Honeybee_createHBSrfs(geometry=ceilings_5, srfType="3")  # -> readMe, simplify(HBSurface); plug-in component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
createhbsrfs_27 = Honeybee_createHBSrfs(geometry=airwalls_5, srfType="4")  # -> readMe, simplify(HBSurface); plug-in component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
createhbsrfs_28 = Honeybee_createHBSrfs(geometry=floors_5, srfType="2")  # -> readMe, simplify(HBSurface); plug-in component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
createhbsrfs_29 = Honeybee_createHBSrfs(geometry=roofs_5, srfType="1")  # -> readMe, simplify(HBSurface); plug-in component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
createhbsrfs_30 = Honeybee_createHBSrfs(geometry=exposedfloors_5, srfType="2.75")  # -> readMe, simplify(HBSurface); plug-in component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
merge_5 = Merge(
    Data1=flatten(createhbsrfs_25.HBSurface),
    Data2=flatten(createhbsrfs_27.HBSurface),
    Data3=flatten(createhbsrfs_26.HBSurface),
    Data4=flatten(createhbsrfs_28.HBSurface),
    Data5=flatten(createhbsrfs_29.HBSurface),
    Data6=flatten(createhbsrfs_30.HBSurface))  # -> flatten(Result)
null_5 = NullItem(Item=merge_5)  # -> NullFlags, InvalidFlags, Description
dispatch_5 = Dispatch(List=merge_5, DispatchPattern=null_5.NullFlags)  # -> ListA, ListB
createhbzones_5 = Honeybee_createHBZones(name="CM2_E_Outer", HBSurfaces=flatten(dispatch_5.ListB), isConditioned=True)  # -> readMe, HBZone; plug-in component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
hbzone_5 = Geometry(createhbzones_5.HBZone)

exposedfloors_6 = Surface()
airwalls_6 = Surface(<surface referenced from the Rhino model>)
ceilings_6 = Surface(<surface referenced from the Rhino model>)
walls_6 = Surface([<surface referenced from the Rhino model> x3])
floors_6 = Surface(<surface referenced from the Rhino model>)
windows_2 = Surface()
roofs_6 = Surface()
createhbsrfs_31 = Honeybee_createHBSrfs(geometry=walls_6, srfType="0")  # -> readMe, simplify(HBSurface); plug-in component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
createhbsrfs_32 = Honeybee_createHBSrfs(geometry=ceilings_6, srfType="3")  # -> readMe, simplify(HBSurface); plug-in component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
createhbsrfs_33 = Honeybee_createHBSrfs(geometry=airwalls_6, srfType="4")  # -> readMe, simplify(HBSurface); plug-in component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
createhbsrfs_34 = Honeybee_createHBSrfs(geometry=floors_6, srfType="2")  # -> readMe, simplify(HBSurface); plug-in component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
createhbsrfs_35 = Honeybee_createHBSrfs(geometry=roofs_6, srfType="1")  # -> readMe, simplify(HBSurface); plug-in component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
createhbsrfs_36 = Honeybee_createHBSrfs(geometry=exposedfloors_6, srfType="2.75")  # -> readMe, simplify(HBSurface); plug-in component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
merge_6 = Merge(
    Data1=flatten(createhbsrfs_31.HBSurface),
    Data2=flatten(createhbsrfs_33.HBSurface),
    Data3=flatten(createhbsrfs_32.HBSurface),
    Data4=flatten(createhbsrfs_34.HBSurface),
    Data5=flatten(createhbsrfs_35.HBSurface),
    Data6=flatten(createhbsrfs_36.HBSurface))  # -> flatten(Result)
null_6 = NullItem(Item=merge_6)  # -> NullFlags, InvalidFlags, Description
dispatch_6 = Dispatch(List=merge_6, DispatchPattern=null_6.NullFlags)  # -> ListA, ListB
createhbzones_6 = Honeybee_createHBZones(name="CM1_SE_Inner", HBSurfaces=flatten(dispatch_6.ListB), isConditioned=True)  # -> readMe, HBZone; plug-in component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
hbzone_6 = Geometry(createhbzones_6.HBZone)

exposedfloors_7 = Surface()
airwalls_7 = Surface(<surface referenced from the Rhino model>)
ceilings_7 = Surface(<surface referenced from the Rhino model>)
walls_7 = Surface([<surface referenced from the Rhino model> x3])
windows_3 = Surface()
floors_7 = Surface(<surface referenced from the Rhino model>)
roofs_7 = Surface()
createhbsrfs_37 = Honeybee_createHBSrfs(geometry=walls_7, srfType="0")  # -> readMe, simplify(HBSurface); plug-in component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
createhbsrfs_38 = Honeybee_createHBSrfs(geometry=ceilings_7, srfType="3")  # -> readMe, simplify(HBSurface); plug-in component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
createhbsrfs_39 = Honeybee_createHBSrfs(geometry=airwalls_7, srfType="4")  # -> readMe, simplify(HBSurface); plug-in component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
createhbsrfs_40 = Honeybee_createHBSrfs(geometry=floors_7, srfType="2")  # -> readMe, simplify(HBSurface); plug-in component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
createhbsrfs_41 = Honeybee_createHBSrfs(geometry=roofs_7, srfType="1")  # -> readMe, simplify(HBSurface); plug-in component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
createhbsrfs_42 = Honeybee_createHBSrfs(geometry=exposedfloors_7, srfType="2.75")  # -> readMe, simplify(HBSurface); plug-in component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
merge_7 = Merge(
    Data1=flatten(createhbsrfs_37.HBSurface),
    Data2=flatten(createhbsrfs_39.HBSurface),
    Data3=flatten(createhbsrfs_38.HBSurface),
    Data4=flatten(createhbsrfs_40.HBSurface),
    Data5=flatten(createhbsrfs_41.HBSurface),
    Data6=flatten(createhbsrfs_42.HBSurface))  # -> flatten(Result)
null_7 = NullItem(Item=merge_7)  # -> NullFlags, InvalidFlags, Description
dispatch_7 = Dispatch(List=merge_7, DispatchPattern=null_7.NullFlags)  # -> ListA, ListB
createhbzones_7 = Honeybee_createHBZones(name="CM1_N_Outer", HBSurfaces=flatten(dispatch_7.ListB), isConditioned=True)  # -> readMe, HBZone; plug-in component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
hbzone_7 = Geometry(createhbzones_7.HBZone)

exposedfloors_8 = Surface()
airwalls_8 = Surface(<surface referenced from the Rhino model>)
ceilings_8 = Surface(<surface referenced from the Rhino model>)
walls_8 = Surface([<surface referenced from the Rhino model> x3])
floors_8 = Surface(<surface referenced from the Rhino model>)
roofs_8 = Surface()
createhbsrfs_43 = Honeybee_createHBSrfs(geometry=walls_8, srfType="0")  # -> readMe, simplify(HBSurface); plug-in component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
createhbsrfs_44 = Honeybee_createHBSrfs(geometry=ceilings_8, srfType="3")  # -> readMe, simplify(HBSurface); plug-in component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
createhbsrfs_45 = Honeybee_createHBSrfs(geometry=airwalls_8, srfType="4")  # -> readMe, simplify(HBSurface); plug-in component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
createhbsrfs_46 = Honeybee_createHBSrfs(geometry=floors_8, srfType="2")  # -> readMe, simplify(HBSurface); plug-in component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
createhbsrfs_47 = Honeybee_createHBSrfs(geometry=roofs_8, srfType="1")  # -> readMe, simplify(HBSurface); plug-in component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
createhbsrfs_48 = Honeybee_createHBSrfs(geometry=exposedfloors_8, srfType="2.75")  # -> readMe, simplify(HBSurface); plug-in component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
merge_8 = Merge(
    Data1=flatten(createhbsrfs_43.HBSurface),
    Data2=flatten(createhbsrfs_45.HBSurface),
    Data3=flatten(createhbsrfs_44.HBSurface),
    Data4=flatten(createhbsrfs_46.HBSurface),
    Data5=flatten(createhbsrfs_47.HBSurface),
    Data6=flatten(createhbsrfs_48.HBSurface))  # -> flatten(Result)
null_8 = NullItem(Item=merge_8)  # -> NullFlags, InvalidFlags, Description
dispatch_8 = Dispatch(List=merge_8, DispatchPattern=null_8.NullFlags)  # -> ListA, ListB
createhbzones_8 = Honeybee_createHBZones(name="CM2_E_Inner", HBSurfaces=flatten(dispatch_8.ListB), isConditioned=True)  # -> readMe, HBZone; plug-in component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
hbzone_8 = Geometry(createhbzones_8.HBZone)

exposedfloors_9 = Surface()
airwalls_9 = Surface(<surface referenced from the Rhino model>)
ceilings_9 = Surface(<surface referenced from the Rhino model>)
walls_9 = Surface([<surface referenced from the Rhino model> x3])
windows_4 = Surface()
floors_9 = Surface(<surface referenced from the Rhino model>)
roofs_9 = Surface()
createhbsrfs_49 = Honeybee_createHBSrfs(geometry=walls_9, srfType="0")  # -> readMe, simplify(HBSurface); plug-in component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
createhbsrfs_50 = Honeybee_createHBSrfs(geometry=ceilings_9, srfType="3")  # -> readMe, simplify(HBSurface); plug-in component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
createhbsrfs_51 = Honeybee_createHBSrfs(geometry=airwalls_9, srfType="4")  # -> readMe, simplify(HBSurface); plug-in component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
createhbsrfs_52 = Honeybee_createHBSrfs(geometry=floors_9, srfType="2")  # -> readMe, simplify(HBSurface); plug-in component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
createhbsrfs_53 = Honeybee_createHBSrfs(geometry=roofs_9, srfType="1")  # -> readMe, simplify(HBSurface); plug-in component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
createhbsrfs_54 = Honeybee_createHBSrfs(geometry=exposedfloors_9, srfType="2.75")  # -> readMe, simplify(HBSurface); plug-in component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
merge_9 = Merge(
    Data1=flatten(createhbsrfs_49.HBSurface),
    Data2=flatten(createhbsrfs_51.HBSurface),
    Data3=flatten(createhbsrfs_50.HBSurface),
    Data4=flatten(createhbsrfs_52.HBSurface),
    Data5=flatten(createhbsrfs_53.HBSurface),
    Data6=flatten(createhbsrfs_54.HBSurface))  # -> flatten(Result)
null_9 = NullItem(Item=merge_9)  # -> NullFlags, InvalidFlags, Description
dispatch_9 = Dispatch(List=merge_9, DispatchPattern=null_9.NullFlags)  # -> ListA, ListB
createhbzones_9 = Honeybee_createHBZones(name="CM1_E_Outer", HBSurfaces=flatten(dispatch_9.ListB), isConditioned=True)  # -> readMe, HBZone; plug-in component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
hbzone_9 = Geometry(createhbzones_9.HBZone)

exposedfloors_10 = Surface()
airwalls_10 = Surface(<surface referenced from the Rhino model>)
ceilings_10 = Surface(<surface referenced from the Rhino model>)
walls_10 = Surface([<surface referenced from the Rhino model> x3])
windows_5 = Surface()
floors_10 = Surface(<surface referenced from the Rhino model>)
roofs_10 = Surface()
createhbsrfs_55 = Honeybee_createHBSrfs(geometry=walls_10, srfType="0")  # -> readMe, simplify(HBSurface); plug-in component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
createhbsrfs_56 = Honeybee_createHBSrfs(geometry=ceilings_10, srfType="3")  # -> readMe, simplify(HBSurface); plug-in component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
createhbsrfs_57 = Honeybee_createHBSrfs(geometry=airwalls_10, srfType="4")  # -> readMe, simplify(HBSurface); plug-in component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
createhbsrfs_58 = Honeybee_createHBSrfs(geometry=floors_10, srfType="2")  # -> readMe, simplify(HBSurface); plug-in component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
createhbsrfs_59 = Honeybee_createHBSrfs(geometry=roofs_10, srfType="1")  # -> readMe, simplify(HBSurface); plug-in component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
createhbsrfs_60 = Honeybee_createHBSrfs(geometry=exposedfloors_10, srfType="2.75")  # -> readMe, simplify(HBSurface); plug-in component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
merge_10 = Merge(
    Data1=flatten(createhbsrfs_55.HBSurface),
    Data2=flatten(createhbsrfs_57.HBSurface),
    Data3=flatten(createhbsrfs_56.HBSurface),
    Data4=flatten(createhbsrfs_58.HBSurface),
    Data5=flatten(createhbsrfs_59.HBSurface),
    Data6=flatten(createhbsrfs_60.HBSurface))  # -> flatten(Result)
null_10 = NullItem(Item=merge_10)  # -> NullFlags, InvalidFlags, Description
dispatch_10 = Dispatch(List=merge_10, DispatchPattern=null_10.NullFlags)  # -> ListA, ListB
createhbzones_10 = Honeybee_createHBZones(name="CM1_N_Inner", HBSurfaces=flatten(dispatch_10.ListB), isConditioned=True)  # -> readMe, HBZone; plug-in component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
hbzone_10 = Geometry(createhbzones_10.HBZone)

exposedfloors_11 = Surface()
airwalls_11 = Surface(<surface referenced from the Rhino model>)
ceilings_11 = Surface(<surface referenced from the Rhino model>)
walls_11 = Surface([<surface referenced from the Rhino model> x3])
windows_6 = Surface()
floors_11 = Surface(<surface referenced from the Rhino model>)
roofs_11 = Surface()
createhbsrfs_61 = Honeybee_createHBSrfs(geometry=walls_11, srfType="0")  # -> readMe, simplify(HBSurface); plug-in component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
createhbsrfs_62 = Honeybee_createHBSrfs(geometry=ceilings_11, srfType="3")  # -> readMe, simplify(HBSurface); plug-in component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
createhbsrfs_63 = Honeybee_createHBSrfs(geometry=airwalls_11, srfType="4")  # -> readMe, simplify(HBSurface); plug-in component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
createhbsrfs_64 = Honeybee_createHBSrfs(geometry=floors_11, srfType="2")  # -> readMe, simplify(HBSurface); plug-in component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
createhbsrfs_65 = Honeybee_createHBSrfs(geometry=roofs_11, srfType="1")  # -> readMe, simplify(HBSurface); plug-in component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
createhbsrfs_66 = Honeybee_createHBSrfs(geometry=exposedfloors_11, srfType="2.75")  # -> readMe, simplify(HBSurface); plug-in component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
merge_11 = Merge(
    Data1=flatten(createhbsrfs_61.HBSurface),
    Data2=flatten(createhbsrfs_63.HBSurface),
    Data3=flatten(createhbsrfs_62.HBSurface),
    Data4=flatten(createhbsrfs_64.HBSurface),
    Data5=flatten(createhbsrfs_65.HBSurface),
    Data6=flatten(createhbsrfs_66.HBSurface))  # -> flatten(Result)
null_11 = NullItem(Item=merge_11)  # -> NullFlags, InvalidFlags, Description
dispatch_11 = Dispatch(List=merge_11, DispatchPattern=null_11.NullFlags)  # -> ListA, ListB
createhbzones_11 = Honeybee_createHBZones(name="CM1_E_Inner", HBSurfaces=flatten(dispatch_11.ListB), isConditioned=True)  # -> readMe, HBZone; plug-in component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
hbzone_11 = Geometry(createhbzones_11.HBZone)

exposedfloors_12 = Surface()
airwalls_12 = Surface(<surface referenced from the Rhino model>)
ceilings_12 = Surface(<surface referenced from the Rhino model>)
walls_12 = Surface([<surface referenced from the Rhino model> x3])
floors_12 = Surface(<surface referenced from the Rhino model>)
roofs_12 = Surface()
createhbsrfs_67 = Honeybee_createHBSrfs(geometry=walls_12, srfType="0")  # -> readMe, simplify(HBSurface); plug-in component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
createhbsrfs_68 = Honeybee_createHBSrfs(geometry=ceilings_12, srfType="3")  # -> readMe, simplify(HBSurface); plug-in component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
createhbsrfs_69 = Honeybee_createHBSrfs(geometry=airwalls_12, srfType="4")  # -> readMe, simplify(HBSurface); plug-in component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
createhbsrfs_70 = Honeybee_createHBSrfs(geometry=floors_12, srfType="2")  # -> readMe, simplify(HBSurface); plug-in component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
createhbsrfs_71 = Honeybee_createHBSrfs(geometry=roofs_12, srfType="1")  # -> readMe, simplify(HBSurface); plug-in component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
createhbsrfs_72 = Honeybee_createHBSrfs(geometry=exposedfloors_12, srfType="2.75")  # -> readMe, simplify(HBSurface); plug-in component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
merge_12 = Merge(
    Data1=flatten(createhbsrfs_67.HBSurface),
    Data2=flatten(createhbsrfs_69.HBSurface),
    Data3=flatten(createhbsrfs_68.HBSurface),
    Data4=flatten(createhbsrfs_70.HBSurface),
    Data5=flatten(createhbsrfs_71.HBSurface),
    Data6=flatten(createhbsrfs_72.HBSurface))  # -> flatten(Result)
null_12 = NullItem(Item=merge_12)  # -> NullFlags, InvalidFlags, Description
dispatch_12 = Dispatch(List=merge_12, DispatchPattern=null_12.NullFlags)  # -> ListA, ListB
createhbzones_12 = Honeybee_createHBZones(name="CM2_N_Inner", HBSurfaces=flatten(dispatch_12.ListB), isConditioned=True)  # -> readMe, HBZone; plug-in component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
hbzone_12 = Geometry(createhbzones_12.HBZone)

exposedfloors_13 = Surface()
airwalls_13 = Surface(<surface referenced from the Rhino model>)
ceilings_13 = Surface(<surface referenced from the Rhino model>)
walls_13 = Surface([<surface referenced from the Rhino model> x3])
windows_7 = Surface()
floors_13 = Surface(<surface referenced from the Rhino model>)
roofs_13 = Surface()
createhbsrfs_73 = Honeybee_createHBSrfs(geometry=walls_13, srfType="0")  # -> readMe, simplify(HBSurface); plug-in component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
createhbsrfs_74 = Honeybee_createHBSrfs(geometry=ceilings_13, srfType="3")  # -> readMe, simplify(HBSurface); plug-in component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
createhbsrfs_75 = Honeybee_createHBSrfs(geometry=airwalls_13, srfType="4")  # -> readMe, simplify(HBSurface); plug-in component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
createhbsrfs_76 = Honeybee_createHBSrfs(geometry=floors_13, srfType="2")  # -> readMe, simplify(HBSurface); plug-in component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
createhbsrfs_77 = Honeybee_createHBSrfs(geometry=roofs_13, srfType="1")  # -> readMe, simplify(HBSurface); plug-in component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
createhbsrfs_78 = Honeybee_createHBSrfs(geometry=exposedfloors_13, srfType="2.75")  # -> readMe, simplify(HBSurface); plug-in component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
merge_13 = Merge(
    Data1=flatten(createhbsrfs_73.HBSurface),
    Data2=flatten(createhbsrfs_75.HBSurface),
    Data3=flatten(createhbsrfs_74.HBSurface),
    Data4=flatten(createhbsrfs_76.HBSurface),
    Data5=flatten(createhbsrfs_77.HBSurface),
    Data6=flatten(createhbsrfs_78.HBSurface))  # -> flatten(Result)
null_13 = NullItem(Item=merge_13)  # -> NullFlags, InvalidFlags, Description
dispatch_13 = Dispatch(List=merge_13, DispatchPattern=null_13.NullFlags)  # -> ListA, ListB
createhbzones_13 = Honeybee_createHBZones(name="CM2_W_Outer", HBSurfaces=flatten(dispatch_13.ListB), isConditioned=True)  # -> readMe, HBZone; plug-in component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
hbzone_13 = Geometry(createhbzones_13.HBZone)

exposedfloors_14 = Surface()
airwalls_14 = Surface(<surface referenced from the Rhino model>)
ceilings_14 = Surface(<surface referenced from the Rhino model>)
walls_14 = Surface([<surface referenced from the Rhino model> x3])
floors_14 = Surface(<surface referenced from the Rhino model>)
windows_8 = Surface()
roofs_14 = Surface()
createhbsrfs_79 = Honeybee_createHBSrfs(geometry=walls_14, srfType="0")  # -> readMe, simplify(HBSurface); plug-in component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
createhbsrfs_80 = Honeybee_createHBSrfs(geometry=ceilings_14, srfType="3")  # -> readMe, simplify(HBSurface); plug-in component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
createhbsrfs_81 = Honeybee_createHBSrfs(geometry=airwalls_14, srfType="4")  # -> readMe, simplify(HBSurface); plug-in component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
createhbsrfs_82 = Honeybee_createHBSrfs(geometry=floors_14, srfType="2")  # -> readMe, simplify(HBSurface); plug-in component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
createhbsrfs_83 = Honeybee_createHBSrfs(geometry=roofs_14, srfType="1")  # -> readMe, simplify(HBSurface); plug-in component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
createhbsrfs_84 = Honeybee_createHBSrfs(geometry=exposedfloors_14, srfType="2.75")  # -> readMe, simplify(HBSurface); plug-in component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
merge_14 = Merge(
    Data1=flatten(createhbsrfs_79.HBSurface),
    Data2=flatten(createhbsrfs_81.HBSurface),
    Data3=flatten(createhbsrfs_80.HBSurface),
    Data4=flatten(createhbsrfs_82.HBSurface),
    Data5=flatten(createhbsrfs_83.HBSurface),
    Data6=flatten(createhbsrfs_84.HBSurface))  # -> flatten(Result)
null_14 = NullItem(Item=merge_14)  # -> NullFlags, InvalidFlags, Description
dispatch_14 = Dispatch(List=merge_14, DispatchPattern=null_14.NullFlags)  # -> ListA, ListB
createhbzones_14 = Honeybee_createHBZones(name="CM2_W_Inner", HBSurfaces=flatten(dispatch_14.ListB), isConditioned=True)  # -> readMe, HBZone; plug-in component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
hbzone_14 = Geometry(createhbzones_14.HBZone)

exposedfloors_15 = Surface()
airwalls_15 = Surface(<surface referenced from the Rhino model>)
ceilings_15 = Surface(<surface referenced from the Rhino model>)
walls_15 = Surface([<surface referenced from the Rhino model> x3])
windows_9 = Surface()
floors_15 = Surface(<surface referenced from the Rhino model>)
roofs_15 = Surface()
createhbsrfs_85 = Honeybee_createHBSrfs(geometry=walls_15, srfType="0")  # -> readMe, simplify(HBSurface); plug-in component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
createhbsrfs_86 = Honeybee_createHBSrfs(geometry=ceilings_15, srfType="3")  # -> readMe, simplify(HBSurface); plug-in component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
createhbsrfs_87 = Honeybee_createHBSrfs(geometry=airwalls_15, srfType="4")  # -> readMe, simplify(HBSurface); plug-in component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
createhbsrfs_88 = Honeybee_createHBSrfs(geometry=floors_15, srfType="2")  # -> readMe, simplify(HBSurface); plug-in component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
createhbsrfs_89 = Honeybee_createHBSrfs(geometry=roofs_15, srfType="1")  # -> readMe, simplify(HBSurface); plug-in component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
createhbsrfs_90 = Honeybee_createHBSrfs(geometry=exposedfloors_15, srfType="2.75")  # -> readMe, simplify(HBSurface); plug-in component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
merge_15 = Merge(
    Data1=flatten(createhbsrfs_85.HBSurface),
    Data2=flatten(createhbsrfs_87.HBSurface),
    Data3=flatten(createhbsrfs_86.HBSurface),
    Data4=flatten(createhbsrfs_88.HBSurface),
    Data5=flatten(createhbsrfs_89.HBSurface),
    Data6=flatten(createhbsrfs_90.HBSurface))  # -> flatten(Result)
null_15 = NullItem(Item=merge_15)  # -> NullFlags, InvalidFlags, Description
dispatch_15 = Dispatch(List=merge_15, DispatchPattern=null_15.NullFlags)  # -> ListA, ListB
createhbzones_15 = Honeybee_createHBZones(name="CM1_SW_Outer", HBSurfaces=flatten(dispatch_15.ListB), isConditioned=True)  # -> readMe, HBZone; plug-in component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
hbzone_15 = Geometry(createhbzones_15.HBZone)

exposedfloors_16 = Surface()
airwalls_16 = Surface(<surface referenced from the Rhino model>)
ceilings_16 = Surface(<surface referenced from the Rhino model>)
walls_16 = Surface([<surface referenced from the Rhino model> x3])
floors_16 = Surface(<surface referenced from the Rhino model>)
windows_10 = Surface()
roofs_16 = Surface()
createhbsrfs_91 = Honeybee_createHBSrfs(geometry=walls_16, srfType="0")  # -> readMe, simplify(HBSurface); plug-in component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
createhbsrfs_92 = Honeybee_createHBSrfs(geometry=ceilings_16, srfType="3")  # -> readMe, simplify(HBSurface); plug-in component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
createhbsrfs_93 = Honeybee_createHBSrfs(geometry=airwalls_16, srfType="4")  # -> readMe, simplify(HBSurface); plug-in component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
createhbsrfs_94 = Honeybee_createHBSrfs(geometry=floors_16, srfType="2")  # -> readMe, simplify(HBSurface); plug-in component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
createhbsrfs_95 = Honeybee_createHBSrfs(geometry=roofs_16, srfType="1")  # -> readMe, simplify(HBSurface); plug-in component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
createhbsrfs_96 = Honeybee_createHBSrfs(geometry=exposedfloors_16, srfType="2.75")  # -> readMe, simplify(HBSurface); plug-in component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
merge_16 = Merge(
    Data1=flatten(createhbsrfs_91.HBSurface),
    Data2=flatten(createhbsrfs_93.HBSurface),
    Data3=flatten(createhbsrfs_92.HBSurface),
    Data4=flatten(createhbsrfs_94.HBSurface),
    Data5=flatten(createhbsrfs_95.HBSurface),
    Data6=flatten(createhbsrfs_96.HBSurface))  # -> flatten(Result)
null_16 = NullItem(Item=merge_16)  # -> NullFlags, InvalidFlags, Description
dispatch_16 = Dispatch(List=merge_16, DispatchPattern=null_16.NullFlags)  # -> ListA, ListB
createhbzones_16 = Honeybee_createHBZones(name="CM1_NW_Outer", HBSurfaces=flatten(dispatch_16.ListB), isConditioned=True)  # -> readMe, HBZone; plug-in component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
hbzone_16 = Geometry(createhbzones_16.HBZone)

exposedfloors_17 = Surface()
airwalls_17 = Surface(<surface referenced from the Rhino model>)
ceilings_17 = Surface(<surface referenced from the Rhino model>)
walls_17 = Surface([<surface referenced from the Rhino model> x3])
windows_11 = Surface()
floors_17 = Surface(<surface referenced from the Rhino model>)
roofs_17 = Surface()
createhbsrfs_97 = Honeybee_createHBSrfs(geometry=walls_17, srfType="0")  # -> readMe, simplify(HBSurface); plug-in component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
createhbsrfs_98 = Honeybee_createHBSrfs(geometry=ceilings_17, srfType="3")  # -> readMe, simplify(HBSurface); plug-in component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
createhbsrfs_99 = Honeybee_createHBSrfs(geometry=airwalls_17, srfType="4")  # -> readMe, simplify(HBSurface); plug-in component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
createhbsrfs_100 = Honeybee_createHBSrfs(geometry=floors_17, srfType="2")  # -> readMe, simplify(HBSurface); plug-in component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
createhbsrfs_101 = Honeybee_createHBSrfs(geometry=roofs_17, srfType="1")  # -> readMe, simplify(HBSurface); plug-in component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
createhbsrfs_102 = Honeybee_createHBSrfs(geometry=exposedfloors_17, srfType="2.75")  # -> readMe, simplify(HBSurface); plug-in component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
merge_17 = Merge(
    Data1=flatten(createhbsrfs_97.HBSurface),
    Data2=flatten(createhbsrfs_99.HBSurface),
    Data3=flatten(createhbsrfs_98.HBSurface),
    Data4=flatten(createhbsrfs_100.HBSurface),
    Data5=flatten(createhbsrfs_101.HBSurface),
    Data6=flatten(createhbsrfs_102.HBSurface))  # -> flatten(Result)
null_17 = NullItem(Item=merge_17)  # -> NullFlags, InvalidFlags, Description
dispatch_17 = Dispatch(List=merge_17, DispatchPattern=null_17.NullFlags)  # -> ListA, ListB
createhbzones_17 = Honeybee_createHBZones(name="CM1_SW_Inner", HBSurfaces=flatten(dispatch_17.ListB), isConditioned=True)  # -> readMe, HBZone; plug-in component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
hbzone_17 = Geometry(createhbzones_17.HBZone)

exposedfloors_18 = Surface()
airwalls_18 = Surface(<surface referenced from the Rhino model>)
ceilings_18 = Surface(<surface referenced from the Rhino model>)
walls_18 = Surface([<surface referenced from the Rhino model> x3])
windows_12 = Surface()
floors_18 = Surface(<surface referenced from the Rhino model>)
roofs_18 = Surface()
createhbsrfs_103 = Honeybee_createHBSrfs(geometry=walls_18, srfType="0")  # -> readMe, simplify(HBSurface); plug-in component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
createhbsrfs_104 = Honeybee_createHBSrfs(geometry=ceilings_18, srfType="3")  # -> readMe, simplify(HBSurface); plug-in component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
createhbsrfs_105 = Honeybee_createHBSrfs(geometry=airwalls_18, srfType="4")  # -> readMe, simplify(HBSurface); plug-in component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
createhbsrfs_106 = Honeybee_createHBSrfs(geometry=floors_18, srfType="2")  # -> readMe, simplify(HBSurface); plug-in component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
createhbsrfs_107 = Honeybee_createHBSrfs(geometry=roofs_18, srfType="1")  # -> readMe, simplify(HBSurface); plug-in component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
createhbsrfs_108 = Honeybee_createHBSrfs(geometry=exposedfloors_18, srfType="2.75")  # -> readMe, simplify(HBSurface); plug-in component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
merge_18 = Merge(
    Data1=flatten(createhbsrfs_103.HBSurface),
    Data2=flatten(createhbsrfs_105.HBSurface),
    Data3=flatten(createhbsrfs_104.HBSurface),
    Data4=flatten(createhbsrfs_106.HBSurface),
    Data5=flatten(createhbsrfs_107.HBSurface),
    Data6=flatten(createhbsrfs_108.HBSurface))  # -> flatten(Result)
null_18 = NullItem(Item=merge_18)  # -> NullFlags, InvalidFlags, Description
dispatch_18 = Dispatch(List=merge_18, DispatchPattern=null_18.NullFlags)  # -> ListA, ListB
createhbzones_18 = Honeybee_createHBZones(name="CM1_NW_Inner", HBSurfaces=flatten(dispatch_18.ListB), isConditioned=True)  # -> readMe, HBZone; plug-in component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
hbzone_18 = Geometry(createhbzones_18.HBZone)

# ---- group: Adjacent zones
panel = Panel("CM1_Adj")
masszones = Geometry([<brep referenced from the Rhino model> x3])
python_script = PythonScript(prefix=panel, masses=masszones)  # -> massNames; inputs masses: list of GeometryBase
# ---------- python_script: Python ----------
massNames = ["{0:}_{1:02d}".format(_prefix, i) for i, j in enumerate(_masses)]
# ---------- end python_script ----------
mass2zone = Honeybee_Masses2Zones(zoneMasses=flatten(masszones), zoneNames=python_script, maxRoofAngle=30, createHBZones=Toggle(True))  # -> readMe, flatten(HBZones); plug-in component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

panel_2 = Panel("CM2_Adj")
masszones_2 = Geometry([<brep referenced from the Rhino model> x3])
python_script_2 = PythonScript(prefix=panel_2, masses=masszones_2)  # -> massNames; inputs masses: list of GeometryBase; same code as python_script
mass2zone_2 = Honeybee_Masses2Zones(zoneMasses=flatten(masszones_2), zoneNames=python_script_2, maxRoofAngle=30, createHBZones=Toggle(True))  # -> readMe, flatten(HBZones); plug-in component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

# ----
merge_19 = Merge(
    Data1=hbzone_7,
    Data2=hbzone_10,
    Data3=hbzone_9,
    Data4=hbzone_11,
    Data5=hbzone_4,
    Data6=hbzone_6,
    Data7=hbzone_15,
    Data8=hbzone_17,
    Data9=hbzone_16,
    Data10=hbzone_18)
merge_20 = Merge(
    Data1=hbzone,
    Data2=hbzone_3,
    Data3=hbzone_2,
    Data4=hbzone_12,
    Data5=hbzone_5,
    Data6=hbzone_8,
    Data7=hbzone_13,
    Data8=hbzone_14)
solveadjc = Honeybee_SolveAdjacencies(HBZones=flatten([merge_19, mass2zone.HBZones]), removeCurrentAdjc=False, findAdjc=Toggle(True))  # -> readMe, HBZonesWADJ; plug-in component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
solveadjc_2 = Honeybee_SolveAdjacencies(HBZones=flatten([merge_20, mass2zone_2.HBZones]), removeCurrentAdjc=False, findAdjc=Toggle(True))  # -> readMe, HBZonesWADJ; plug-in component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
number_slider = Slider(2, range=0..3)
number_slider_2 = Slider(0.2, range=0.1..0.4)
glazingratio = Panel("0.4")
getsethbobjname = Honeybee_GetOrSetHBObjectName(HBObjects=solveadjc.HBZonesWADJ)  # -> HBObjects, names; plug-in component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
getsethbobjname_2 = Honeybee_GetOrSetHBObjectName(HBObjects=solveadjc_2.HBZonesWADJ)  # -> HBObjects, names; plug-in component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
cm1shadenumber = Number(number_slider)
cm2shadenumber = Number(number_slider)
cm2glazingratio = Number(glazingratio)
cm1shadedepth = Number(number_slider_2)
cm2shadedepth = Number(number_slider_2)
cm1glazingratio = Number(glazingratio)
python = PythonScript(names=getsethbobjname.names, exclude=panel)  # -> mask; inputs names: list
# ---------- python: Python ----------
mask = []
for i in _names:
    if _exclude in i:
        mask.append(True)
    else:
        mask.append(False)
# ---------- end python ----------
python_2 = PythonScript(names=getsethbobjname_2.names, exclude=panel_2)  # -> mask; inputs names: list; same code as python
dispatch_19 = Dispatch(List=solveadjc.HBZonesWADJ, DispatchPattern=python)  # -> ListA, ListB
dispatch_20 = Dispatch(List=solveadjc_2.HBZonesWADJ, DispatchPattern=python_2)  # -> ListA, ListB
glazingcreator = Honeybee_GlazingBasedOnRatio(HBObjects=dispatch_19.ListB, glzRatio=cm1glazingratio, runIt=Toggle(True))  # -> readMe, HBObjWGLZ; plug-in component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
glazingcreator_2 = Honeybee_GlazingBasedOnRatio(HBObjects=dispatch_20.ListB, glzRatio=cm2glazingratio, runIt=Toggle(True))  # -> readMe, HBObjWGLZ; plug-in component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
merge_21 = Merge(Data1=dispatch_19.ListA, Data2=glazingcreator.HBObjWGLZ)  # -> flatten(Result)
merge_22 = Merge(Data1=dispatch_20.ListA, Data2=glazingcreator_2.HBObjWGLZ)  # -> flatten(Result)
epwindowshades = Honeybee_EnergyPlusWindowShadeGenerator(HBObjects=flatten(merge_21), distToGlass="0.1", depth=cm1shadedepth, numOfShds=cm1shadenumber, runIt=Toggle(True))  # -> readMe, port, HBObjWShades, port_2, windowBreps, shadeBreps, port_3, shadeMatName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; plug-in component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
epwindowshades_2 = Honeybee_EnergyPlusWindowShadeGenerator(HBObjects=flatten(merge_22), distToGlass="0.1", depth=cm2shadedepth, numOfShds=cm2shadenumber, runIt=Toggle(True))  # -> readMe, port, HBObjWShades, port_2, windowBreps, shadeBreps, port_3, shadeMatName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; plug-in component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
decomposebytype = Honeybee_DecomposeBasedOnType(HBZone=merge_22)  # -> walls, interiorWalls, airWalls, windows, interiorWindows, skylights, roofs, ceilings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; plug-in component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
contextbuildings = Geometry(<brep referenced from the Rhino model>)
merge_23 = Merge(Data1=epwindowshades.shadeBreps, Data2=epwindowshades_2.shadeBreps, Data3=contextbuildings)

# ---- group: SHADING
hb_epcontextsrf = HoneybeeEPContextSurfaces(shdSurfaces=flatten(merge_23))  # -> HBContext; inputs shdSurfaces: list of Brep, justBoundingBox: Boolean
# ---------- hb_epcontextsrf: Python ----------
"""
prepare shading/context geometries

    Args:
        northVectorOrRotation: A vector that shows North or a number that shows
                               the rotation of the North from the Y axis
        bldgMasses: List of closed Breps as thermal zones.
    Returns:
        report: ...
        thermalZones: Thermal zone's geometries for visualiza
"""

ghenv.Component.Name = 'Honeybee EP context Surfaces'
ghenv.Component.NickName = 'HB_EPContextSrf'
ghenv.Component.Message = 'VER 0.0.63\nJAN_20_2018'
ghenv.Component.IconDisplayMode = ghenv.Component.IconDisplayMode.application
ghenv.Component.Category = "Honeybee"
ghenv.Component.SubCategory = "10 | Energy | Energy"
#compatibleHBVersion = VER 0.0.57\nNOV_04_2016
#compatibleLBVersion = VER 0.0.59\nFEB_01_2015
ghenv.Component.AdditionalHelpFromDocStrings = "2"

import rhinoscriptsyntax as rs
import Rhino as rc
import scriptcontext as sc
import os
import System
import Grasshopper.Kernel as gh
import uuid

tolerance = sc.doc.ModelAbsoluteTolerance
import math


def main(shdSurfaces, EPTransSchedule, meshingSettings, justBoundingBox):
    
    # import the classes
    if sc.sticky.has_key('honeybee_release'):

        try:
            if not sc.sticky['honeybee_release'].isCompatible(ghenv.Component): return -1
            if sc.sticky['honeybee_release'].isInputMissing(ghenv.Component): return -1
        except:
            warning = "You need a newer version of Honeybee to use this compoent." + \
            " Use updateHoneybee component to update userObjects.\n" + \
            "If you have already updated userObjects drag Honeybee_Honeybee component " + \
            "into canvas and try again."
            w = gh.GH_RuntimeMessageLevel.Warning
            ghenv.Component.AddRuntimeMessage(w, warning)
            return -1
        
        # don't customize this part
        hb_EPSrf = sc.sticky["honeybee_EPSurface"]
        hb_EPSHDSurface = sc.sticky["honeybee_EPShdSurface"]
        hb_RADMaterialAUX = sc.sticky["honeybee_RADMaterialAUX"]
        hb_EPObjectsAux = sc.sticky["honeybee_EPObjectsAUX"]()
        HBScheduleList = sc.sticky["honeybee_ScheduleLib"].keys()

        ########################################################################
        #----------------------------------------------------------------------#
        shdBreps = []
        # create bounding box of shading geometries
        if justBoundingBox:
            for brep in shdSurfaces:
                if brep.Faces.Count>1 or not brep.Faces[0].IsPlanar(sc.doc.ModelAbsoluteTolerance):
                    shdBreps.append(brep.GetBoundingBox(True).ToBrep())
                else:
                    shdBreps.append(brep)
        else:
            shdBreps = shdSurfaces
        
        shadingClasses = []
        shadingMeshPreview = []
        
        if meshingSettings == None:
            mp = rc.Geometry.MeshingParameters.Minimal
            mp.SimplePlanes = True
        else:
            mp = meshingSettings
        
        def getRadMaterialName(radMaterial):
            nameStr = radMaterial.split(" ")[2]
            name =  nameStr.split("\n")[0]
            return name
        
        for brepCount, brep in enumerate(shdBreps):
            if brep != None:
                isPlanar = True
                # check planarity
                for face in brep.Faces:
                    if not face.IsPlanar(tolerance):
                        isPlanar = False
                        break
                
                shadingBreps = []
                if not isPlanar:
                    meshArray = rc.Geometry.Mesh.CreateFromBrep(brep, mp)
                    for mesh in meshArray:
                        for meshFace in range(mesh.Faces.Count):
                            vertices = list(mesh.Faces.GetFaceVertices(meshFace))[1:]
                            vertices = vertices + [sc.doc.ModelAbsoluteTolerance]
                            # create the brep from mesh
                            shdBrep = rc.Geometry.Brep.CreateFromCornerPoints(*vertices)
                            shadingBreps.append(shdBrep)
                else:
                    for face in brep.Faces:
                        shadingBreps.append(face.DuplicateFace(False))
                
                for faceCount, shdBrep in enumerate(shadingBreps):
                        thisShading = hb_EPSHDSurface(shdBrep, 1000*brepCount + faceCount, 'shdSrf_' + `brepCount` + '_' + `faceCount` + "_" + str(uuid.uuid4()))
                        
                        # add transmittance schedule if any
                        if EPTransSchedule!=None:
                            schedule= EPTransSchedule.upper()
                            if schedule!=None and not schedule.lower().endswith(".csv") and schedule not in HBScheduleList:
                                msg = "Cannot find " + schedule + " in Honeybee schedule library."
                                print msg
                                ghenv.Component.AddRuntimeMessage(gh.GH_RuntimeMessageLevel.Warning, msg)
                                return -1
                            elif schedule!=None and schedule.lower().endswith(".csv"):
                                # check if csv file is existed
                                if not os.path.isfile(schedule):
                                    msg = "Cannot find the shchedule file: " + schedule
                                    print msg
                                    ghenv.Component.AddRuntimeMessage(gh.GH_RuntimeMessageLevel.Warning, msg)
                                    return -1
                            
                            thisShading.TransmittanceSCH = schedule
                        
                        # add the Rad Material if any
                        if RADMaterial!=None:
                            # if it is just the name of the material make sure it is already defined
                            if len(RADMaterial.split(" ")) == 1:
                                # if the material is not in the library add it to the library
                                if not hb_RADMaterialAUX.isMatrialExistInLibrary(RADMaterial):
                                    warningMsg = "Can't find " + RADMaterial + " in RAD Material Library.\n" + \
                                                "Add the material to the library and try again."
                                    ghenv.Component.AddRuntimeMessage(gh.GH_RuntimeMessageLevel.Warning, warningMsg)
                                    return
                                
                                try:
                                    thisShading.setRADMaterial(RADMaterial)
                                except Exception, e:
                                    print e
                                    warningMsg = "You are using an old version of Honeybee_Honeybee! Update your files and try again."
                                    print warningMsg
                                    ghenv.Component.AddRuntimeMessage(gh.GH_RuntimeMessageLevel.Warning, warningMsg)
                                    return
                                
                                addedToLib = True
                            else:
                                
                                # try to add the material to the library
                                addedToLib, thisShading.RadMaterial = hb_RADMaterialAUX.analyseRadMaterials(RADMaterial, True)
                                
                            if addedToLib==False:
                                warningMsg = "Failed to add " + RADMaterial + " to the Library."
                                ghenv.Component.AddRuntimeMessage(gh.GH_RuntimeMessageLevel.Warning, warningMsg)
                                return
                        
                        # add shading to the list
                        shadingClasses.append(thisShading)
                
        # add to the hive
        hb_hive = sc.sticky["honeybee_Hive"]()
        HBContext  = hb_hive.addToHoneybeeHive(shadingClasses, ghenv.Component)
        return HBContext
        ################################################################################################
    else:
        print "You should first let Honeybee to fly..."
        w = gh.GH_RuntimeMessageLevel.Warning
        ghenv.Component.AddRuntimeMessage(w, "You should first let Honeybee to fly...")
        return -1
        

if _shdSurfaces and _shdSurfaces[0]!=None:
    # add cleaning function
    result= main(_shdSurfaces, EPTransSchedule_, meshingSettings_, justBoundingBox_)
    
    if result != -1: HBContext = result
# ---------- end hb_epcontextsrf ----------

# ---- group: ZONES
merge_24 = Merge(Data1=merge_21, Data2=merge_22)

# ----
decomposebytype_2 = Honeybee_DecomposeBasedOnType(HBZone=merge_24)  # -> walls, interiorWalls, airWalls, windows, interiorWindows, skylights, roofs, ceilings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; plug-in component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
swatch = ColourSwatch(SwatchColor=RGB(176, 0, 0))
swatch_2 = ColourSwatch(SwatchColor=RGB(0, 209, 181))
swatch_3 = ColourSwatch(SwatchColor=RGBA(120, 241, 255, 124))
entwine = Entwine(
    Branch00=decomposebytype_2.walls,
    Branch01=decomposebytype_2.interiorWalls,
    Branch02=decomposebytype_2.airWalls,
    Branch03=decomposebytype_2.windows,
    Branch04=decomposebytype_2.interiorWindows,
    Branch05=decomposebytype_2.skylights,
    Branch06=decomposebytype_2.roofs,
    Branch07=decomposebytype_2.ceilings,
    Branch08=decomposebytype_2.floors,
    Branch09=decomposebytype_2.exposedFloors,
    Branch010=decomposebytype_2.groundFloors,
    Branch011=decomposebytype_2.undergroundWalls,
    Branch012=decomposebytype_2.undergroundSlabs,
    Branch013=decomposebytype_2.undergroundCeilings,
    Branch014=decomposebytype_2.shadings,
    FlattenInputs=True)
entwine_2 = Entwine(
    Branch00=ColourSwatch(SwatchColor=RGB(255, 179, 56)),
    Branch01=ColourSwatch(SwatchColor=RGB(0, 140, 2)),
    Branch02=ColourSwatch(SwatchColor=RGB(171, 171, 171)),
    Branch03=swatch_3,
    Branch04=swatch_3,
    Branch05=ColourSwatch(SwatchColor=RGBA(255, 94, 255, 147)),
    Branch06=swatch,
    Branch07=swatch,
    Branch08=swatch_2,
    Branch09=swatch_2,
    Branch010=swatch_2,
    Branch011=ColourSwatch(SwatchColor=RGB(255, 255, 255)),
    Branch012=ColourSwatch(SwatchColor=RGB(255, 255, 255)),
    Branch013=ColourSwatch(SwatchColor=RGB(255, 255, 255)),
    Branch014=ColourSwatch(SwatchColor=RGB(255, 255, 255)),
    FlattenInputs=True)
solveadjc_3 = Honeybee_SolveAdjacencies(HBZones=flatten([merge_22, merge_21]), removeCurrentAdjc=False, findAdjc=Toggle(True))  # -> readMe, HBZonesWADJ; plug-in component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
preview = CustomPreview(
    Geometry=decomposebytype_2.walls,
    Shader={ambient=RGB(0, 0, 0), diffuse=RGB(255, 105, 180), emission=RGB(76, 32, 54), shine=0.5, specular=RGB(255, 255, 255), transparency=0})
preview_2 = CustomPreview(Geometry=entwine, Shader=entwine_2)
panel_3 = Panel("C:\Users\tgerrish\Desktop\SAMAzure\TestFiles\GBR_Cardiff_CIBSE_TRY.epw")
runenergysimulation = Honeybee_RunEnergySimulation(
    epwFile=panel_3,
    HBZones=flatten(solveadjc_3.HBZonesWADJ),
    HBContext=flatten(hb_epcontextsrf),
    writeIdf=Toggle(False),
    workingDir="C:\Users\tgerrish\Desktop\SAMAzure\TestFiles",
    idfFileName="test")  # -> readMe, idfFileAddress, resultFileAddress, eioFileAddress, rddFileAddress, htmlReport, studyFolder; plug-in component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
panel_4 = Panel(runenergysimulation.readMe)
