# Grasshopper definition RhinoHoneybeeToIDF_Basic.gh (Grasshopper 0.9.76)
# plug-ins: Python Interpreter

honeybee = Honeybee_Honeybee()  # -> Vviiiiiiiiiizzz; plug-in component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
ladybug = Ladybug_Ladybug()  # -> Vviiiiiiiiiizzz; plug-in component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
panel = Panel("C:\Users\tgerrish\Desktop\SAMAzure\TestFiles\GBR_Cardiff_CIBSE_TRY.epw")

ceilings = Surface(<surface referenced from the Rhino model>)
windows = Surface([<surface referenced from the Rhino model> x4])
walls = Surface([<surface referenced from the Rhino model> x4])
airwalls = Surface(<surface referenced from the Rhino model>)
floors = Surface(<surface referenced from the Rhino model>)
roofs = Surface()
exposedfloors = Surface()
createhbsrfs = Honeybee_createHBSrfs(geometry=walls, srfType="0")  # -> readMe, simplify(HBSurface); plug-in component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
createhbsrfs_2 = Honeybee_createHBSrfs(geometry=ceilings, srfType="3")  # -> readMe, simplify(HBSurface); plug-in component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
createhbsrfs_3 = Honeybee_createHBSrfs(geometry=airwalls, srfType="4")  # -> readMe, simplify(HBSurface); plug-in component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
createhbsrfs_4 = Honeybee_createHBSrfs(geometry=floors, srfType="2")  # -> readMe, simplify(HBSurface); plug-in component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
createhbsrfs_5 = Honeybee_createHBSrfs(geometry=roofs, srfType="1")  # -> readMe, simplify(HBSurface); plug-in component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
createhbsrfs_6 = Honeybee_createHBSrfs(geometry=exposedfloors, srfType="2.75")  # -> readMe, simplify(HBSurface); plug-in component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
merge = Merge(
    Data1=flatten(createhbsrfs.HBSurface),
    Data2=flatten(createhbsrfs_3.HBSurface),
    Data3=flatten(createhbsrfs_2.HBSurface),
    Data4=flatten(createhbsrfs_4.HBSurface),
    Data5=flatten(createhbsrfs_5.HBSurface),
    Data6=flatten(createhbsrfs_6.HBSurface))  # -> flatten(Result)
null = NullItem(Item=merge)  # -> NullFlags, InvalidFlags, Description
dispatch = Dispatch(List=merge, DispatchPattern=null.NullFlags)  # -> ListA, ListB
createhbzones = Honeybee_createHBZones(name="zone3", HBSurfaces=flatten(dispatch.ListB), isConditioned=True)  # -> readMe, HBZone; plug-in component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

ceilings_2 = Surface(<surface referenced from the Rhino model>)
walls_2 = Surface([<surface referenced from the Rhino model> x4])
airwalls_2 = Surface(<surface referenced from the Rhino model>)
floors_2 = Surface(<surface referenced from the Rhino model>)
roofs_2 = Surface()
exposedfloors_2 = Surface()
createhbsrfs_7 = Honeybee_createHBSrfs(geometry=walls_2, srfType="0")  # -> readMe, simplify(HBSurface); plug-in component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
createhbsrfs_8 = Honeybee_createHBSrfs(geometry=ceilings_2, srfType="3")  # -> readMe, simplify(HBSurface); plug-in component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
createhbsrfs_9 = Honeybee_createHBSrfs(geometry=airwalls_2, srfType="4")  # -> readMe, simplify(HBSurface); plug-in component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
createhbsrfs_10 = Honeybee_createHBSrfs(geometry=floors_2, srfType="2")  # -> readMe, simplify(HBSurface); plug-in component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
createhbsrfs_11 = Honeybee_createHBSrfs(geometry=roofs_2, srfType="1")  # -> readMe, simplify(HBSurface); plug-in component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
createhbsrfs_12 = Honeybee_createHBSrfs(geometry=exposedfloors_2, srfType="2.75")  # -> readMe, simplify(HBSurface); plug-in component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
windows_2 = Surface([<surface referenced from the Rhino model> x2])
merge_2 = Merge(
    Data1=flatten(createhbsrfs_7.HBSurface),
    Data2=flatten(createhbsrfs_9.HBSurface),
    Data3=flatten(createhbsrfs_8.HBSurface),
    Data4=flatten(createhbsrfs_10.HBSurface),
    Data5=flatten(createhbsrfs_11.HBSurface),
    Data6=flatten(createhbsrfs_12.HBSurface))  # -> flatten(Result)
null_2 = NullItem(Item=merge_2)  # -> NullFlags, InvalidFlags, Description
dispatch_2 = Dispatch(List=merge_2, DispatchPattern=null_2.NullFlags)  # -> ListA, ListB
createhbzones_2 = Honeybee_createHBZones(name="zone4", HBSurfaces=flatten(dispatch_2.ListB), isConditioned=True)  # -> readMe, HBZone; plug-in component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

walls_3 = Surface([<surface referenced from the Rhino model> x4])
airwalls_3 = Surface(<surface referenced from the Rhino model>)
ceilings_3 = Surface(<surface referenced from the Rhino model>)
floors_3 = Surface(<surface referenced from the Rhino model>)
roofs_3 = Surface()
exposedfloors_3 = Surface()
windows_3 = Surface([<surface referenced from the Rhino model> x4])
createhbsrfs_13 = Honeybee_createHBSrfs(geometry=walls_3, srfType="0")  # -> readMe, simplify(HBSurface); plug-in component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
createhbsrfs_14 = Honeybee_createHBSrfs(geometry=ceilings_3, srfType="3")  # -> readMe, simplify(HBSurface); plug-in component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
createhbsrfs_15 = Honeybee_createHBSrfs(geometry=airwalls_3, srfType="4")  # -> readMe, simplify(HBSurface); plug-in component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
createhbsrfs_16 = Honeybee_createHBSrfs(geometry=floors_3, srfType="2")  # -> readMe, simplify(HBSurface); plug-in component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
createhbsrfs_17 = Honeybee_createHBSrfs(geometry=roofs_3, srfType="1")  # -> readMe, simplify(HBSurface); plug-in component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
createhbsrfs_18 = Honeybee_createHBSrfs(geometry=exposedfloors_3, srfType="2.75")  # -> readMe, simplify(HBSurface); plug-in component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
merge_3 = Merge(
    Data1=flatten(createhbsrfs_13.HBSurface),
    Data2=flatten(createhbsrfs_15.HBSurface),
    Data3=flatten(createhbsrfs_14.HBSurface),
    Data4=flatten(createhbsrfs_16.HBSurface),
    Data5=flatten(createhbsrfs_17.HBSurface),
    Data6=flatten(createhbsrfs_18.HBSurface))  # -> flatten(Result)
null_3 = NullItem(Item=merge_3)  # -> NullFlags, InvalidFlags, Description
dispatch_3 = Dispatch(List=merge_3, DispatchPattern=null_3.NullFlags)  # -> ListA, ListB
createhbzones_3 = Honeybee_createHBZones(name="zone1", HBSurfaces=flatten(dispatch_3.ListB), isConditioned=True)  # -> readMe, HBZone; plug-in component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

ceilings_4 = Surface(<surface referenced from the Rhino model>)
windows_4 = Surface([<surface referenced from the Rhino model> x3])
panel_2 = Panel("5")
walls_4 = Surface([<surface referenced from the Rhino model> x4])
airwalls_4 = Surface(<surface referenced from the Rhino model>)
floors_4 = Surface(<surface referenced from the Rhino model>)
roofs_4 = Surface()
exposedfloors_4 = Surface()
createhbsrfs_19 = Honeybee_createHBSrfs(geometry=walls_4, srfType="0")  # -> readMe, simplify(HBSurface); plug-in component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
createhbsrfs_20 = Honeybee_createHBSrfs(geometry=ceilings_4, srfType="3")  # -> readMe, simplify(HBSurface); plug-in component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
createhbsrfs_21 = Honeybee_createHBSrfs(geometry=airwalls_4, srfType="4")  # -> readMe, simplify(HBSurface); plug-in component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
createhbsrfs_22 = Honeybee_createHBSrfs(geometry=floors_4, srfType="2")  # -> readMe, simplify(HBSurface); plug-in component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
createhbsrfs_23 = Honeybee_createHBSrfs(geometry=roofs_4, srfType="1")  # -> readMe, simplify(HBSurface); plug-in component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
createhbsrfs_24 = Honeybee_createHBSrfs(geometry=exposedfloors_4, srfType="2.75")  # -> readMe, simplify(HBSurface); plug-in component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
merge_4 = Merge(
    Data1=flatten(createhbsrfs_19.HBSurface),
    Data2=flatten(createhbsrfs_21.HBSurface),
    Data3=flatten(createhbsrfs_20.HBSurface),
    Data4=flatten(createhbsrfs_22.HBSurface),
    Data5=flatten(createhbsrfs_23.HBSurface),
    Data6=flatten(createhbsrfs_24.HBSurface))  # -> flatten(Result)
null_4 = NullItem(Item=merge_4)  # -> NullFlags, InvalidFlags, Description
dispatch_4 = Dispatch(List=merge_4, DispatchPattern=null_4.NullFlags)  # -> ListA, ListB
createhbzones_4 = Honeybee_createHBZones(name="zone2", HBSurfaces=flatten(dispatch_4.ListB), isConditioned=True)  # -> readMe, HBZone; plug-in component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

addhbglz = Honeybee_addHBGlz(HBObj=createhbzones_4.HBZone, childSurfaces=flatten(windows_4))  # -> HBObjWGLZ; plug-in component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
addhbglz_2 = Honeybee_addHBGlz(HBObj=createhbzones_3.HBZone, childSurfaces=flatten(windows_3))  # -> HBObjWGLZ; plug-in component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
addhbglz_3 = Honeybee_addHBGlz(HBObj=createhbzones_2.HBZone, childSurfaces=flatten(windows_2))  # -> HBObjWGLZ; plug-in component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
addhbglz_4 = Honeybee_addHBGlz(HBObj=createhbzones.HBZone, childSurfaces=flatten(windows))  # -> HBObjWGLZ; plug-in component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
merge_5 = Merge(Data1=addhbglz_2, Data2=addhbglz, Data3=addhbglz_4, Data4=addhbglz_3)
solveadjc = Honeybee_SolveAdjacencies(HBZones=flatten(merge_5), removeCurrentAdjc=False, findAdjc=Toggle(True))  # -> readMe, HBZonesWADJ; plug-in component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
epwindowshades = Honeybee_EnergyPlusWindowShadeGenerator(HBObjects=flatten(solveadjc.HBZonesWADJ), distToGlass="0.1", depth="0.25", numOfShds="2", runIt=Toggle(True))  # -> readMe, port, HBObjWShades, port_2, windowBreps, shadeBreps, port_3, shadeMatName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; plug-in component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
lng = ListLength(List=epwindowshades.shadeBreps)  # -> flatten(Length)
larger = LargerThan(FirstNumber=lng, SecondNumber="2")  # -> graft(LargerThan), OrEqualTo
dispatch_5 = Dispatch(List=epwindowshades.shadeBreps, DispatchPattern=larger.LargerThan)  # -> ListA, simplify(ListB)
clean = CleanTree(RemoveNulls=True, RemoveInvalid=True, RemoveEmpty=Toggle(True), Tree=dispatch_5.ListB)  # -> flatten(Tree)
hb_epcontextsrf = HoneybeeEPContextSurfaces(shdSurfaces=flatten(clean))  # -> HBContext; inputs shdSurfaces: list of Brep, justBoundingBox: Boolean
# ---------- hb_epcontextsrf: Python ----------
"""
prepare shading/context geometries

    Args:
        northVectorOrRotation: A vector that shows North or a number that shows
                               the rotation of the North from the Y axis
        bldgMasses: List of closed Breps as thermal zones.
    Returns:
        report: ...
        thermalZones: Thermal zone's geometries for visualiza
"""

ghenv.Component.Name = 'Honeybee EP context Surfaces'
ghenv.Component.NickName = 'HB_EPContextSrf'
ghenv.Component.Message = 'VER 0.0.63\nJAN_20_2018'
ghenv.Component.IconDisplayMode = ghenv.Component.IconDisplayMode.application
ghenv.Component.Category = "Honeybee"
ghenv.Component.SubCategory = "10 | Energy | Energy"
#compatibleHBVersion = VER 0.0.57\nNOV_04_2016
#compatibleLBVersion = VER 0.0.59\nFEB_01_2015
ghenv.Component.AdditionalHelpFromDocStrings = "2"

import rhinoscriptsyntax as rs
import Rhino as rc
import scriptcontext as sc
import os
import System
import Grasshopper.Kernel as gh
import uuid

tolerance = sc.doc.ModelAbsoluteTolerance
import math


def main(shdSurfaces, EPTransSchedule, meshingSettings, justBoundingBox):
    
    # import the classes
    if sc.sticky.has_key('honeybee_release'):

        try:
            if not sc.sticky['honeybee_release'].isCompatible(ghenv.Component): return -1
            if sc.sticky['honeybee_release'].isInputMissing(ghenv.Component): return -1
        except:
            warning = "You need a newer version of Honeybee to use this compoent." + \
            " Use updateHoneybee component to update userObjects.\n" + \
            "If you have already updated userObjects drag Honeybee_Honeybee component " + \
            "into canvas and try again."
            w = gh.GH_RuntimeMessageLevel.Warning
            ghenv.Component.AddRuntimeMessage(w, warning)
            return -1
        
        # don't customize this part
        hb_EPSrf = sc.sticky["honeybee_EPSurface"]
        hb_EPSHDSurface = sc.sticky["honeybee_EPShdSurface"]
        hb_RADMaterialAUX = sc.sticky["honeybee_RADMaterialAUX"]
        hb_EPObjectsAux = sc.sticky["honeybee_EPObjectsAUX"]()
        HBScheduleList = sc.sticky["honeybee_ScheduleLib"].keys()

        ########################################################################
        #----------------------------------------------------------------------#
        shdBreps = []
        # create bounding box of shading geometries
        if justBoundingBox:
            for brep in shdSurfaces:
                if brep.Faces.Count>1 or not brep.Faces[0].IsPlanar(sc.doc.ModelAbsoluteTolerance):
                    shdBreps.append(brep.GetBoundingBox(True).ToBrep())
                else:
                    shdBreps.append(brep)
        else:
            shdBreps = shdSurfaces
        
        shadingClasses = []
        shadingMeshPreview = []
        
        if meshingSettings == None:
            mp = rc.Geometry.MeshingParameters.Minimal
            mp.SimplePlanes = True
        else:
            mp = meshingSettings
        
        def getRadMaterialName(radMaterial):
            nameStr = radMaterial.split(" ")[2]
            name =  nameStr.split("\n")[0]
            return name
        
        for brepCount, brep in enumerate(shdBreps):
            if brep != None:
                isPlanar = True
                # check planarity
                for face in brep.Faces:
                    if not face.IsPlanar(tolerance):
                        isPlanar = False
                        break
                
                shadingBreps = []
                if not isPlanar:
                    meshArray = rc.Geometry.Mesh.CreateFromBrep(brep, mp)
                    for mesh in meshArray:
                        for meshFace in range(mesh.Faces.Count):
                            vertices = list(mesh.Faces.GetFaceVertices(meshFace))[1:]
                            vertices = vertices + [sc.doc.ModelAbsoluteTolerance]
                            # create the brep from mesh
                            shdBrep = rc.Geometry.Brep.CreateFromCornerPoints(*vertices)
                            shadingBreps.append(shdBrep)
                else:
                    for face in brep.Faces:
                        shadingBreps.append(face.DuplicateFace(False))
                
                for faceCount, shdBrep in enumerate(shadingBreps):
                        thisShading = hb_EPSHDSurface(shdBrep, 1000*brepCount + faceCount, 'shdSrf_' + `brepCount` + '_' + `faceCount` + "_" + str(uuid.uuid4()))
                        
                        # add transmittance schedule if any
                        if EPTransSchedule!=None:
                            schedule= EPTransSchedule.upper()
                            if schedule!=None and not schedule.lower().endswith(".csv") and schedule not in HBScheduleList:
                                msg = "Cannot find " + schedule + " in Honeybee schedule library."
                                print msg
                                ghenv.Component.AddRuntimeMessage(gh.GH_RuntimeMessageLevel.Warning, msg)
                                return -1
                            elif schedule!=None and schedule.lower().endswith(".csv"):
                                # check if csv file is existed
                                if not os.path.isfile(schedule):
                                    msg = "Cannot find the shchedule file: " + schedule
                                    print msg
                                    ghenv.Component.AddRuntimeMessage(gh.GH_RuntimeMessageLevel.Warning, msg)
                                    return -1
                            
                            thisShading.TransmittanceSCH = schedule
                        
                        # add the Rad Material if any
                        if RADMaterial!=None:
                            # if it is just the name of the material make sure it is already defined
                            if len(RADMaterial.split(" ")) == 1:
                                # if the material is not in the library add it to the library
                                if not hb_RADMaterialAUX.isMatrialExistInLibrary(RADMaterial):
                                    warningMsg = "Can't find " + RADMaterial + " in RAD Material Library.\n" + \
                                                "Add the material to the library and try again."
                                    ghenv.Component.AddRuntimeMessage(gh.GH_RuntimeMessageLevel.Warning, warningMsg)
                                    return
                                
                                try:
                                    thisShading.setRADMaterial(RADMaterial)
                                except Exception, e:
                                    print e
                                    warningMsg = "You are using an old version of Honeybee_Honeybee! Update your files and try again."
                                    print warningMsg
                                    ghenv.Component.AddRuntimeMessage(gh.GH_RuntimeMessageLevel.Warning, warningMsg)
                                    return
                                
                                addedToLib = True
                            else:
                                
                                # try to add the material to the library
                                addedToLib, thisShading.RadMaterial = hb_RADMaterialAUX.analyseRadMaterials(RADMaterial, True)
                                
                            if addedToLib==False:
                                warningMsg = "Failed to add " + RADMaterial + " to the Library."
                                ghenv.Component.AddRuntimeMessage(gh.GH_RuntimeMessageLevel.Warning, warningMsg)
                                return
                        
                        # add shading to the list
                        shadingClasses.append(thisShading)
                
        # add to the hive
        hb_hive = sc.sticky["honeybee_Hive"]()
        HBContext  = hb_hive.addToHoneybeeHive(shadingClasses, ghenv.Component)
        return HBContext
        ################################################################################################
    else:
        print "You should first let Honeybee to fly..."
        w = gh.GH_RuntimeMessageLevel.Warning
        ghenv.Component.AddRuntimeMessage(w, "You should first let Honeybee to fly...")
        return -1
        

if _shdSurfaces and _shdSurfaces[0]!=None:
    # add cleaning function
    result= main(_shdSurfaces, EPTransSchedule_, meshingSettings_, justBoundingBox_)
    
    if result != -1: HBContext = result
# ---------- end hb_epcontextsrf ----------
decomposebytype = Honeybee_DecomposeBasedOnType(HBZone=solveadjc.HBZonesWADJ)  # -> walls, interiorWalls, airWalls, windows, interiorWindows, skylights, roofs, ceilings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; plug-in component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
runenergysimulation = Honeybee_RunEnergySimulation(
    epwFile=panel,
    HBZones=flatten(solveadjc.HBZonesWADJ),
    HBContext=flatten(hb_epcontextsrf),
    writeIdf=Toggle(True),
    workingDir="C:\Users\tgerrish\Desktop\SAMAzure\TestFiles",
    idfFileName="test_basic")  # -> readMe, idfFileAddress, resultFileAddress, eioFileAddress, rddFileAddress, htmlReport, studyFolder; plug-in component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
preview = CustomPreview(
    Geometry=decomposebytype.airWalls,
    Shader={ambient=RGB(0, 0, 0), diffuse=RGB(255, 105, 180), emission=RGB(76, 32, 54), shine=0.5, specular=RGB(255, 255, 255), transparency=0})
panel_3 = Panel(runenergysimulation.readMe)
