# Grasshopper definition basicroom.gh (Grasshopper 0.9.76)
# plug-ins: Python Interpreter

honeybee = Honeybee_Honeybee()  # -> Vviiiiiiiiiizzz; plug-in component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
ladybug = Ladybug_Ladybug()  # -> Vviiiiiiiiiizzz; plug-in component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
toggle = BooleanToggle(True)
brep = Brep(<brep referenced from the Rhino model>)
mass2zone = Honeybee_Masses2Zones(zoneMasses=flatten(brep), maxRoofAngle=30, createHBZones=toggle)  # -> readMe, HBZones; plug-in component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
radopaquematerial = HoneybeePlus_RadianceOpaqueMaterial(name="wall_ish", reflect="0.6", spec=0, rough=0)  # -> material; plug-in component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
radglassmaterial = HoneybeePlus_RadianceGlassMaterial(name="window", tVis="0.5")  # -> material; plug-in component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
glazingcreator = Honeybee_GlazingBasedOnRatio(HBObjects=mass2zone.HBZones, glzRatio="0.4", runIt=toggle)  # -> readMe, HBObjWGLZ; plug-in component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
epwindowshades = Honeybee_EnergyPlusWindowShadeGenerator(HBObjects=flatten(glazingcreator.HBObjWGLZ), distToGlass="0.05", depth="0.3", numOfShds="2", runIt=toggle)  # -> readMe, port, HBObjWShades, port_2, windowBreps, shadeBreps, port_3, shadeMatName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; plug-in component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
decomposebytype = Honeybee_DecomposeBasedOnType(HBZone=glazingcreator.HBObjWGLZ)  # -> walls, interiorWalls, airWalls, windows, interiorWindows, skylights, roofs, ceilings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; plug-in component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
panel = Panel("C:\Users\tgerrish\Desktop\SAMAzure\TestFiles\GBR_Cardiff_CIBSE_TRY.epw")
wea = HoneybeePlus_Wea(epwFile=panel)  # -> wea; plug-in component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
skymatrix = HoneybeePlus_SkyMatrix(north=0, wea=wea, density=1)  # -> skymtx; plug-in component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
hbsurface = HoneybeePlus_HoneybeeSurface(
    geo=flatten([decomposebytype.walls, decomposebytype.interiorWalls, decomposebytype.roofs, decomposebytype.ceilings, decomposebytype.floors, decomposebytype.exposedFloors, decomposebytype.groundFloors, decomposebytype.undergroundWalls, decomposebytype.undergroundSlabs, decomposebytype.undergroundCeilings, epwindowshades.shadeBreps]),
    radMat=radopaquematerial)  # -> report, HBSrf; plug-in component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
flip = Flip(Surface=decomposebytype.groundFloors)  # -> Surface, Result
hbsurface_2 = HoneybeePlus_HoneybeeSurface(
    geo=flatten([decomposebytype.windows, decomposebytype.interiorWindows, decomposebytype.skylights]),
    type="5",
    radMat=radglassmaterial)  # -> report, HBSrf; plug-in component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
genmesh = Ladybug_GenerateMesh(testGeometry=flip.Surface, gridSize="0.25", distBaseSrf="0.8", moveTestMesh=True)  # -> readMe, simplify(testPoints), simplify(ptsVectors), simplify(facesArea), simplify(mesh); plug-in component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
merge = Merge(Data1=hbsurface.HBSrf, Data2=hbsurface_2.HBSrf)  # -> flatten(Result)
toggle_2 = BooleanToggle(True)
analysisgrid = HoneybeePlus_AnalysisGrid(name="analysis_grid_test", testPoints=genmesh.testPoints)  # -> analysisGrid; plug-in component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
dfrecipe = HoneybeePlus_DaylightFactorRecipe(analysisGrids=analysisgrid)  # -> analysisRecipe; plug-in component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
annualdlrecipe = HoneybeePlus_AnnualDaylightRecipe(skymtx=skymatrix, analysisGrids=analysisgrid, analysisType="0", reuseDmtx=False)  # -> analysisRecipe; plug-in component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
runradiance = HoneybeePlus_RunRadianceAnalysis(analysisRecipe=dfrecipe, HBObjects=merge, folder="c:\ladybug", name="testing_df_recipe", write=toggle_2)  # -> report, legendPar, outputs; plug-in component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
runradiance_2 = HoneybeePlus_RunRadianceAnalysis(analysisRecipe=annualdlrecipe, HBObjects=merge, folder="c:\ladybug", name="testing_annual_recipe", write=toggle_2)  # -> report, legendPar, outputs; plug-in component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
